% Simulink data dictionary mainDB.sldd
% references subDB_VALUE.sldd

SystemType_typ_s = struct(MOCSType=single(0), NumofGE=single(0), HeatingSystem=single(0), FOSuppUnit=single(0))

CMDI_typ = Simulink.Bus()
  AlarmReset: boolean
  PLCpowerFail_Reserved: boolean
  InternalpowerFail: boolean
  ExternalpowerFail: boolean
  FanpowerFail: boolean
  ESDcircuitpowerFail: boolean

CMDI_typ_s = struct(
  AlarmReset=false,
  PLCpowerFail_Reserved=false,
  InternalpowerFail=false,
  ExternalpowerFail=false,
  FanpowerFail=false,
  ESDcircuitpowerFail=false)

CMDO_typ = Simulink.Bus()
  MOCSCommonAlarm: boolean
  MOCSCommonAlarmLamp: boolean
  MOCSCommonAlarmBuzzer: boolean

CMDO_typ_s = struct(MOCSCommonAlarm=false, MOCSCommonAlarmLamp=false, MOCSCommonAlarmBuzzer=false)

CommMOCSIO_typ = Simulink.Bus()
  DIPro: Bus: CMDI_typ
  DOPro: Bus: CMDO_typ

CommMOCSIO_typ_s = struct(
  DIPro=struct(
    AlarmReset=false,
    PLCpowerFail_Reserved=false,
    InternalpowerFail=false,
    ExternalpowerFail=false,
    FanpowerFail=false,
    ESDcircuitpowerFail=false),
  DOPro=struct(MOCSCommonAlarm=false, MOCSCommonAlarmLamp=false, MOCSCommonAlarmBuzzer=false))

CFAI_typ = Simulink.Bus()
  FOSupplyInletPress: single
  FOSupplyOutletPress: single

CFAI_typ_s = struct(FOSupplyInletPress=single(0), FOSupplyOutletPress=single(0))

CFDI_typ = Simulink.Bus()
  FOSupplypumpAutomode: boolean
  No1FOSupplypumpRemote: boolean
  No1FOSupplypumpAbnormal: boolean
  No1FOSupplypumpRunning: boolean
  No2FOSupplypumpRemote: boolean
  No2FOSupplypumpAbnormal: boolean
  No2FOSupplypumpRunning: boolean

CFDI_typ_s = struct(
  FOSupplypumpAutomode=false,
  No1FOSupplypumpRemote=false,
  No1FOSupplypumpAbnormal=false,
  No1FOSupplypumpRunning=false,
  No2FOSupplypumpRemote=false,
  No2FOSupplypumpAbnormal=false,
  No2FOSupplypumpRunning=false)

CFDO_typ = Simulink.Bus()
  No1FOSupplypumpRunCommand: boolean
  No2FOSupplypumpRunCommand: boolean

CFDO_typ_s = struct(No1FOSupplypumpRunCommand=false, No2FOSupplypumpRunCommand=false)

CommFODSIO_typ = Simulink.Bus()
  AIPro: Bus: CFAI_typ
  DIPro: Bus: CFDI_typ
  DOPro: Bus: CFDO_typ

CommFODSIO_typ_s = struct(
  AIPro=struct(FOSupplyInletPress=single(0), FOSupplyOutletPress=single(0)),
  DIPro=struct(
    FOSupplypumpAutomode=false,
    No1FOSupplypumpRemote=false,
    No1FOSupplypumpAbnormal=false,
    No1FOSupplypumpRunning=false,
    No2FOSupplypumpRemote=false,
    No2FOSupplypumpAbnormal=false,
    No2FOSupplypumpRunning=false),
  DOPro=struct(No1FOSupplypumpRunCommand=false, No2FOSupplypumpRunCommand=false))

IMAI_typ = Simulink.Bus()
  MixerInletTemp: single
  ChamberInletTemp: single
  ChamberMiddleTemp: single
  ChamberOutletTemp: single
  ChamberDiffPress: single
  VentingSealingAirInletPress: single
  RBVPDT: single
  RTVPDT: single
  RTVFeedback: single

IMAO_typ = Simulink.Bus()
  RTVSetpoint: single

IMAO_typ_s = struct(RTVSetpoint=single(0))

IMDI_typ = Simulink.Bus()
  GELowSulfurfuelsupplied: boolean
  MOCSRemoteLocal: boolean
  MOCSEmcystopFrompanel: boolean
  MOCSEmcystopFromECR: boolean
  MOCSEmcystopFromBridge: boolean
  MOCSStart: boolean
  MOCSPreparation: boolean
  MOCSStop: boolean
  RSVFeedback_Open: boolean
  RSVFeedback_Closed: boolean
  RBVFeedback_Open: boolean
  RBVFeedback_Closed: boolean

IMDO_typ = Simulink.Bus()
  MOCSReady: boolean
  AllFlowThroughMOCS: boolean
  MOCSActive: boolean
  RSVSetpoint: boolean
  RBVSetpoint: boolean
  VentingSealingSolVV: boolean

IMDO_typ_s = struct(
  MOCSReady=false,
  AllFlowThroughMOCS=false,
  MOCSActive=false,
  RSVSetpoint=false,
  RBVSetpoint=false,
  VentingSealingSolVV=false)

IndivMOCSIO_typ = Simulink.Bus()
  AIPro: Bus: IMAI_typ
  AOPro: Bus: IMAO_typ
  DIPro: Bus: IMDI_typ
  DOPro: Bus: IMDO_typ

IndivMOCSIO_typ_s = struct(
  AIPro=struct(
    MixerInletTemp=single(0),
    ChamberInletTemp=single(0),
    ChamberMiddleTemp=single(0),
    ChamberOutletTemp=single(0),
    ChamberDiffPress=single(0),
    VentingSealingAirInletPress=single(0),
    RBVPDT=single(0),
    RTVPDT=single(0),
    RTVFeedback=single(0)),
  AOPro=struct(RTVSetpoint=single(0)),
  DIPro=struct(
    GELowSulfurfuelsupplied=false,
    MOCSRemoteLocal=false,
    MOCSEmcystopFrompanel=false,
    MOCSEmcystopFromECR=false,
    MOCSEmcystopFromBridge=false,
    MOCSStart=false,
    MOCSPreparation=false,
    MOCSStop=false,
    RSVFeedback_Open=false,
    RSVFeedback_Closed=false,
    RBVFeedback_Open=false,
    RBVFeedback_Closed=false),
  DOPro=struct(
    MOCSReady=false,
    AllFlowThroughMOCS=false,
    MOCSActive=false,
    RSVSetpoint=false,
    RBVSetpoint=false,
    VentingSealingSolVV=false))

IFAI_typ = Simulink.Bus()
  FODAtomizingAirInletPress: single
  FODAtomizingAirOutletPress: single
  FODFuelOilInletPress: single
  FODFuelOilMiddlePress: single
  FODFuelOilFlowrate_Feedback: single
  FODFuelOilOutletPress: single

IFAI_typ_s = struct(
  FODAtomizingAirInletPress=single(0),
  FODAtomizingAirOutletPress=single(0),
  FODFuelOilInletPress=single(0),
  FODFuelOilMiddlePress=single(0),
  FODFuelOilFlowrate_Feedback=single(0),
  FODFuelOilOutletPress=single(0))

IFAO_typ = Simulink.Bus()
  FODFuelOilControlVV_Setpoint: single

IFAO_typ_s = struct(FODFuelOilControlVV_Setpoint=single(0))

IFDI_typ = Simulink.Bus()
  FODFuelOilInletTemp: boolean

IFDI_typ_s = struct(FODFuelOilInletTemp=false)

IFDO_typ = Simulink.Bus()
  MOCSFODsystemFlushRun: boolean
  FODAtomizingAirSolVV: boolean
  FODPurgingAirSolVV: boolean
  FODFuelOilInletSolVV: boolean
  FODFuelOilOutletSolVV: boolean
  FODFuelOilReturnSolVV: boolean

IFDO_typ_s = struct(
  MOCSFODsystemFlushRun=false,
  FODAtomizingAirSolVV=false,
  FODPurgingAirSolVV=false,
  FODFuelOilInletSolVV=false,
  FODFuelOilOutletSolVV=false,
  FODFuelOilReturnSolVV=false)

IndivFODSIO_typ = Simulink.Bus()
  AIPro: Bus: IFAI_typ
  AOPro: Bus: IFAO_typ
  DIPro: Bus: IFDI_typ
  DOPro: Bus: IFDO_typ

IndivFODSIO_typ_s = struct(
  AIPro=struct(
    FODAtomizingAirInletPress=single(0),
    FODAtomizingAirOutletPress=single(0),
    FODFuelOilInletPress=single(0),
    FODFuelOilMiddlePress=single(0),
    FODFuelOilFlowrate_Feedback=single(0),
    FODFuelOilOutletPress=single(0)),
  AOPro=struct(FODFuelOilControlVV_Setpoint=single(0)),
  DIPro=struct(FODFuelOilInletTemp=false),
  DOPro=struct(
    MOCSFODsystemFlushRun=false,
    FODAtomizingAirSolVV=false,
    FODPurgingAirSolVV=false,
    FODFuelOilInletSolVV=false,
    FODFuelOilOutletSolVV=false,
    FODFuelOilReturnSolVV=false))

ISDI_typ = Simulink.Bus()
  SCRValveFeedback_Open: boolean
  SCRValveFeedback_Close: boolean

ISDI_typ_s = struct(SCRValveFeedback_Open=false, SCRValveFeedback_Close=false)

ISDO_typ = Simulink.Bus()
  SCRValveSetpoint: boolean

ISDO_typ_s = struct(SCRValveSetpoint=false)

IndivSCRIO_typ = Simulink.Bus()
  DIPro: Bus: ISDI_typ
  DOPro: Bus: ISDO_typ

IndivSCRIO_typ_s = struct(
  DIPro=struct(SCRValveFeedback_Open=false, SCRValveFeedback_Close=false),
  DOPro=struct(SCRValveSetpoint=false))

DIAlarm_typ = Simulink.Bus()
  DH: boolean
  DL: boolean

DIAlarm_typ_s = struct(DH=false, DL=false)

AIAlarm_typ = Simulink.Bus()
  SF: boolean
  LL: boolean
  LO: boolean
  HO: boolean
  HH: boolean

AIAlarm_typ_s = struct(SF=false, LL=false, LO=false, HO=false, HH=false)

CHD_typ = Simulink.Bus()
  CommonAI1ModuleFault: boolean
  CommonDI1ModuleFault: boolean
  CommonDO1ModuleFault: boolean
  FOpumpAutomode_HA: Bus: DIAlarm_typ
  AlarmReset_HR: Bus: DIAlarm_typ
  LCpowerFail_LF: Bus: DIAlarm_typ
  InternalpowerFail_LF: Bus: DIAlarm_typ
  ExternalpowerFail_LF: Bus: DIAlarm_typ
  FanpowerFail_LF: Bus: DIAlarm_typ
  ESDcircuitpowerFail_LF: Bus: DIAlarm_typ
  No1FOpumpRemote_HR: Bus: DIAlarm_typ
  No1FOpumpAbnormal_LA: Bus: DIAlarm_typ
  No1FOpumpRunning_HR: Bus: DIAlarm_typ
  No2FOpumpRemote_HR: Bus: DIAlarm_typ
  No2FOpumpAbnormal_LA: Bus: DIAlarm_typ
  No2FOpumpRunning_HR: Bus: DIAlarm_typ
  CDI1CH14Reserved_HR: Bus: DIAlarm_typ
  CDI1CH15Reserved_HR: Bus: DIAlarm_typ
  CDI1CH16Reserved_HR: Bus: DIAlarm_typ
  FOSupplyInletPress: Bus: AIAlarm_typ
  FOSupplyOutletPress: Bus: AIAlarm_typ
  CAI1CH3Reserved: Bus: AIAlarm_typ
  CAI1CH4Reserved: Bus: AIAlarm_typ
  CAI1CH5Reserved: Bus: AIAlarm_typ
  CAI1CH6Reserved: Bus: AIAlarm_typ
  CAI1CH7Reserved: Bus: AIAlarm_typ
  CAI1CH8Reserved: Bus: AIAlarm_typ

IF_ALARM = struct(
  Comm=struct(
    CHD=struct(
      CommonAI1ModuleFault=false,
      CommonDI1ModuleFault=false,
      CommonDO1ModuleFault=false,
      FOpumpAutomode_HA=struct(DH=false, DL=false),
      AlarmReset_HR=struct(DH=false, DL=false),
      LCpowerFail_LF=struct(DH=false, DL=false),
      InternalpowerFail_LF=struct(DH=false, DL=false),
      ExternalpowerFail_LF=struct(DH=false, DL=false),
      FanpowerFail_LF=struct(DH=false, DL=false),
      ESDcircuitpowerFail_LF=struct(DH=false, DL=false),
      No1FOpumpRemote_HR=struct(DH=false, DL=false),
      No1FOpumpAbnormal_LA=struct(DH=false, DL=false),
      No1FOpumpRunning_HR=struct(DH=false, DL=false),
      No2FOpumpRemote_HR=struct(DH=false, DL=false),
      No2FOpumpAbnormal_LA=struct(DH=false, DL=false),
      No2FOpumpRunning_HR=struct(DH=false, DL=false),
      CDI1CH14Reserved_HR=struct(DH=false, DL=false),
      CDI1CH15Reserved_HR=struct(DH=false, DL=false),
      CDI1CH16Reserved_HR=struct(DH=false, DL=false),
      FOSupplyInletPress=struct(SF=false, LL=false, LO=false, HO=false, HH=false),
      FOSupplyOutletPress=struct(SF=false, LL=false, LO=false, HO=false, HH=false),
      CAI1CH3Reserved=struct(SF=false, LL=false, LO=false, HO=false, HH=false),
      CAI1CH4Reserved=struct(SF=false, LL=false, LO=false, HO=false, HH=false),
      CAI1CH5Reserved=struct(SF=false, LL=false, LO=false, HO=false, HH=false),
      CAI1CH6Reserved=struct(SF=false, LL=false, LO=false, HO=false, HH=false),
      CAI1CH7Reserved=struct(SF=false, LL=false, LO=false, HO=false, HH=false),
      CAI1CH8Reserved=struct(SF=false, LL=false, LO=false, HO=false, HH=false)),
    CUD=struct(CommunicationFailwithHMI=false, No1FOsupplypumpFail=false, No2FOsupplypumpFail=false)),
  No1=struct(
    IHD=struct(
      AI1ModuleFault=false,
      AI2ModuleFault=false,
      AI3ModuleFault=false,
      AO1ModuleFault=false,
      DI1ModuleFault=false,
      DO1ModuleFault=false,
      LowSulfurfuelsupplied_H0=struct(DH=false, DL=false),
      MOCSRemoteLocal_HR=struct(DH=false, DL=false),
      MOCSEmcystopFpanel_LE=struct(DH=false, DL=false),
      MOCSEmcystopFECR_LE=struct(DH=false, DL=false),
      MOCSEmcystopFBridge_LE=struct(DH=false, DL=false),
      MOCSStart_HS=struct(DH=false, DL=false),
      MOCSPreparation_HP=struct(DH=false, DL=false),
      MOCSStop_HS=struct(DH=false, DL=false),
      RSVFeedback_HO=struct(DH=false, DL=false),
      RSVFeedback_HC=struct(DH=false, DL=false),
      RBVFeedback_HO=struct(DH=false, DL=false),
      RBVFeedback_HC=struct(DH=false, DL=false),
      FODosFOInletTemp_L=struct(DH=false, DL=false),
      SCRValveFeedback_HO=struct(DH=false, DL=false),
      SCRValveFeedback_HC=struct(DH=false, DL=false),
      DI1CH16Reserved_HC=struct(DH=false, DL=false),
      MixerInletTemp=struct(SF=false, LL=false, LO=false, HO=false, HH=false),
      ChamberInletTemp=struct(SF=false, LL=false, LO=false, HO=false, HH=false),
      ChamberMiddleTemp=struct(SF=false, LL=false, LO=false, HO=false, HH=false),
      ChamberOutletTemp=struct(SF=false, LL=false, LO=false, HO=false, HH=false),
      ChamberDiffPress=struct(SF=false, LL=false, LO=false, HO=false, HH=false),
      VnSAirInletPress=struct(SF=false, LL=false, LO=false, HO=false, HH=false),
      AI1CH7Reserved=struct(SF=false, LL=false, LO=false, HO=false, HH=false),
      AI1CH8Reserved=struct(SF=false, LL=false, LO=false, HO=false, HH=false),
      RBVPDT=struct(SF=false, LL=false, LO=false, HO=false, HH=false),
      RTVPDT=struct(SF=false, LL=false, LO=false, HO=false, HH=false),
      RTVFeedback=struct(SF=false, LL=false, LO=false, HO=false, HH=false),
      AI2CH4Reserved=struct(SF=false, LL=false, LO=false, HO=false, HH=false),
      AI2CH5Reserved=struct(SF=false, LL=false, LO=false, HO=false, HH=false),
      AI2CH6Reserved=struct(SF=false, LL=false, LO=false, HO=false, HH=false),
      AI2CH7Reserved=struct(SF=false, LL=false, LO=false, HO=false, HH=false),
      AI2CH8Reserved=struct(SF=false, LL=false, LO=false, HO=false, HH=false),
      FODosAirInletPress=struct(SF=false, LL=false, LO=false, HO=false, HH=false),
      FODosAirOutletPress=struct(SF=false, LL=false, LO=false, HO=false, HH=false),
      FODosFOInletPress=struct(SF=false, LL=false, LO=false, HO=false, HH=false),
      FODosFOMiddlePress=struct(SF=false, LL=false, LO=false, HO=false, HH=false),
      FODosFOFlowrateFeedback=struct(SF=false, LL=false, LO=false, HO=false, HH=false),
      FODosFOOutletPress=struct(SF=false, LL=false, LO=false, HO=false, HH=false),
      AI3CH7Reserved=struct(SF=false, LL=false, LO=false, HO=false, HH=false),
      AI3CH8Reserved=struct(SF=false, LL=false, LO=false, HO=false, HH=false)),
    IUD=struct(
      CommunicationFailwithAMS=false,
      EGSuddenDieselTransfer=false,
      EGstoppedduringgas=false,
      MSSNormalFail=false,
      TMBTimeout=false,
      RemoteStopWhileTMB=false,
      MOCSNotReady=false,
      RSVFail=false,
      RSVFeedbackSF=false,
      RBVFail=false,
      RBVFeedbackSF=false,
      SCRValveFail=false,
      SCRValveFeedbackSF=false,
      RTVFail=false,
      RTVDev=false,
      DosingFOFlowDev=false,
      DosingFOFlowDevTimeout=false,
      DosingFOLimitSatTimeout=false,
      RTVPDTSFMOCSNotready=false)),
  No2=struct(
    IHD=struct(
      AI1ModuleFault=false,
      AI2ModuleFault=false,
      AI3ModuleFault=false,
      AO1ModuleFault=false,
      DI1ModuleFault=false,
      DO1ModuleFault=false,
      LowSulfurfuelsupplied_H0=struct(DH=false, DL=false),
      MOCSRemoteLocal_HR=struct(DH=false, DL=false),
      MOCSEmcystopFpanel_LE=struct(DH=false, DL=false),
      MOCSEmcystopFECR_LE=struct(DH=false, DL=false),
      MOCSEmcystopFBridge_LE=struct(DH=false, DL=false),
      MOCSStart_HS=struct(DH=false, DL=false),
      MOCSPreparation_HP=struct(DH=false, DL=false),
      MOCSStop_HS=struct(DH=false, DL=false),
      RSVFeedback_HO=struct(DH=false, DL=false),
      RSVFeedback_HC=struct(DH=false, DL=false),
      RBVFeedback_HO=struct(DH=false, DL=false),
      RBVFeedback_HC=struct(DH=false, DL=false),
      FODosFOInletTemp_L=struct(DH=false, DL=false),
      SCRValveFeedback_HO=struct(DH=false, DL=false),
      SCRValveFeedback_HC=struct(DH=false, DL=false),
      DI1CH16Reserved_HC=struct(DH=false, DL=false),
      MixerInletTemp=struct(SF=false, LL=false, LO=false, HO=false, HH=false),
      ChamberInletTemp=struct(SF=false, LL=false, LO=false, HO=false, HH=false),
      ChamberMiddleTemp=struct(SF=false, LL=false, LO=false, HO=false, HH=false),
      ChamberOutletTemp=struct(SF=false, LL=false, LO=false, HO=false, HH=false),
      ChamberDiffPress=struct(SF=false, LL=false, LO=false, HO=false, HH=false),
      VnSAirInletPress=struct(SF=false, LL=false, LO=false, HO=false, HH=false),
      AI1CH7Reserved=struct(SF=false, LL=false, LO=false, HO=false, HH=false),
      AI1CH8Reserved=struct(SF=false, LL=false, LO=false, HO=false, HH=false),
      RBVPDT=struct(SF=false, LL=false, LO=false, HO=false, HH=false),
      RTVPDT=struct(SF=false, LL=false, LO=false, HO=false, HH=false),
      RTVFeedback=struct(SF=false, LL=false, LO=false, HO=false, HH=false),
      AI2CH4Reserved=struct(SF=false, LL=false, LO=false, HO=false, HH=false),
      AI2CH5Reserved=struct(SF=false, LL=false, LO=false, HO=false, HH=false),
      AI2CH6Reserved=struct(SF=false, LL=false, LO=false, HO=false, HH=false),
      AI2CH7Reserved=struct(SF=false, LL=false, LO=false, HO=false, HH=false),
      AI2CH8Reserved=struct(SF=false, LL=false, LO=false, HO=false, HH=false),
      FODosAirInletPress=struct(SF=false, LL=false, LO=false, HO=false, HH=false),
      FODosAirOutletPress=struct(SF=false, LL=false, LO=false, HO=false, HH=false),
      FODosFOInletPress=struct(SF=false, LL=false, LO=false, HO=false, HH=false),
      FODosFOMiddlePress=struct(SF=false, LL=false, LO=false, HO=false, HH=false),
      FODosFOFlowrateFeedback=struct(SF=false, LL=false, LO=false, HO=false, HH=false),
      FODosFOOutletPress=struct(SF=false, LL=false, LO=false, HO=false, HH=false),
      AI3CH7Reserved=struct(SF=false, LL=false, LO=false, HO=false, HH=false),
      AI3CH8Reserved=struct(SF=false, LL=false, LO=false, HO=false, HH=false)),
    IUD=struct(
      CommunicationFailwithAMS=false,
      EGSuddenDieselTransfer=false,
      EGstoppedduringgas=false,
      MSSNormalFail=false,
      TMBTimeout=false,
      RemoteStopWhileTMB=false,
      MOCSNotReady=false,
      RSVFail=false,
      RSVFeedbackSF=false,
      RBVFail=false,
      RBVFeedbackSF=false,
      SCRValveFail=false,
      SCRValveFeedbackSF=false,
      RTVFail=false,
      RTVDev=false,
      DosingFOFlowDev=false,
      DosingFOFlowDevTimeout=false,
      DosingFOLimitSatTimeout=false,
      RTVPDTSFMOCSNotready=false)),
  No3=struct(
    IHD=struct(
      AI1ModuleFault=false,
      AI2ModuleFault=false,
      AI3ModuleFault=false,
      AO1ModuleFault=false,
      DI1ModuleFault=false,
      DO1ModuleFault=false,
      LowSulfurfuelsupplied_H0=struct(DH=false, DL=false),
      MOCSRemoteLocal_HR=struct(DH=false, DL=false),
      MOCSEmcystopFpanel_LE=struct(DH=false, DL=false),
      MOCSEmcystopFECR_LE=struct(DH=false, DL=false),
      MOCSEmcystopFBridge_LE=struct(DH=false, DL=false),
      MOCSStart_HS=struct(DH=false, DL=false),
      MOCSPreparation_HP=struct(DH=false, DL=false),
      MOCSStop_HS=struct(DH=false, DL=false),
      RSVFeedback_HO=struct(DH=false, DL=false),
      RSVFeedback_HC=struct(DH=false, DL=false),
      RBVFeedback_HO=struct(DH=false, DL=false),
      RBVFeedback_HC=struct(DH=false, DL=false),
      FODosFOInletTemp_L=struct(DH=false, DL=false),
      SCRValveFeedback_HO=struct(DH=false, DL=false),
      SCRValveFeedback_HC=struct(DH=false, DL=false),
      DI1CH16Reserved_HC=struct(DH=false, DL=false),
      MixerInletTemp=struct(SF=false, LL=false, LO=false, HO=false, HH=false),
      ChamberInletTemp=struct(SF=false, LL=false, LO=false, HO=false, HH=false),
      ChamberMiddleTemp=struct(SF=false, LL=false, LO=false, HO=false, HH=false),
      ChamberOutletTemp=struct(SF=false, LL=false, LO=false, HO=false, HH=false),
      ChamberDiffPress=struct(SF=false, LL=false, LO=false, HO=false, HH=false),
      VnSAirInletPress=struct(SF=false, LL=false, LO=false, HO=false, HH=false),
      AI1CH7Reserved=struct(SF=false, LL=false, LO=false, HO=false, HH=false),
      AI1CH8Reserved=struct(SF=false, LL=false, LO=false, HO=false, HH=false),
      RBVPDT=struct(SF=false, LL=false, LO=false, HO=false, HH=false),
      RTVPDT=struct(SF=false, LL=false, LO=false, HO=false, HH=false),
      RTVFeedback=struct(SF=false, LL=false, LO=false, HO=false, HH=false),
      AI2CH4Reserved=struct(SF=false, LL=false, LO=false, HO=false, HH=false),
      AI2CH5Reserved=struct(SF=false, LL=false, LO=false, HO=false, HH=false),
      AI2CH6Reserved=struct(SF=false, LL=false, LO=false, HO=false, HH=false),
      AI2CH7Reserved=struct(SF=false, LL=false, LO=false, HO=false, HH=false),
      AI2CH8Reserved=struct(SF=false, LL=false, LO=false, HO=false, HH=false),
      FODosAirInletPress=struct(SF=false, LL=false, LO=false, HO=false, HH=false),
      FODosAirOutletPress=struct(SF=false, LL=false, LO=false, HO=false, HH=false),
      FODosFOInletPress=struct(SF=false, LL=false, LO=false, HO=false, HH=false),
      FODosFOMiddlePress=struct(SF=false, LL=false, LO=false, HO=false, HH=false),
      FODosFOFlowrateFeedback=struct(SF=false, LL=false, LO=false, HO=false, HH=false),
      FODosFOOutletPress=struct(SF=false, LL=false, LO=false, HO=false, HH=false),
      AI3CH7Reserved=struct(SF=false, LL=false, LO=false, HO=false, HH=false),
      AI3CH8Reserved=struct(SF=false, LL=false, LO=false, HO=false, HH=false)),
    IUD=struct(
      CommunicationFailwithAMS=false,
      EGSuddenDieselTransfer=false,
      EGstoppedduringgas=false,
      MSSNormalFail=false,
      TMBTimeout=false,
      RemoteStopWhileTMB=false,
      MOCSNotReady=false,
      RSVFail=false,
      RSVFeedbackSF=false,
      RBVFail=false,
      RBVFeedbackSF=false,
      SCRValveFail=false,
      SCRValveFeedbackSF=false,
      RTVFail=false,
      RTVDev=false,
      DosingFOFlowDev=false,
      DosingFOFlowDevTimeout=false,
      DosingFOLimitSatTimeout=false,
      RTVPDTSFMOCSNotready=false)),
  No4=struct(
    IHD=struct(
      AI1ModuleFault=false,
      AI2ModuleFault=false,
      AI3ModuleFault=false,
      AO1ModuleFault=false,
      DI1ModuleFault=false,
      DO1ModuleFault=false,
      LowSulfurfuelsupplied_H0=struct(DH=false, DL=false),
      MOCSRemoteLocal_HR=struct(DH=false, DL=false),
      MOCSEmcystopFpanel_LE=struct(DH=false, DL=false),
      MOCSEmcystopFECR_LE=struct(DH=false, DL=false),
      MOCSEmcystopFBridge_LE=struct(DH=false, DL=false),
      MOCSStart_HS=struct(DH=false, DL=false),
      MOCSPreparation_HP=struct(DH=false, DL=false),
      MOCSStop_HS=struct(DH=false, DL=false),
      RSVFeedback_HO=struct(DH=false, DL=false),
      RSVFeedback_HC=struct(DH=false, DL=false),
      RBVFeedback_HO=struct(DH=false, DL=false),
      RBVFeedback_HC=struct(DH=false, DL=false),
      FODosFOInletTemp_L=struct(DH=false, DL=false),
      SCRValveFeedback_HO=struct(DH=false, DL=false),
      SCRValveFeedback_HC=struct(DH=false, DL=false),
      DI1CH16Reserved_HC=struct(DH=false, DL=false),
      MixerInletTemp=struct(SF=false, LL=false, LO=false, HO=false, HH=false),
      ChamberInletTemp=struct(SF=false, LL=false, LO=false, HO=false, HH=false),
      ChamberMiddleTemp=struct(SF=false, LL=false, LO=false, HO=false, HH=false),
      ChamberOutletTemp=struct(SF=false, LL=false, LO=false, HO=false, HH=false),
      ChamberDiffPress=struct(SF=false, LL=false, LO=false, HO=false, HH=false),
      VnSAirInletPress=struct(SF=false, LL=false, LO=false, HO=false, HH=false),
      AI1CH7Reserved=struct(SF=false, LL=false, LO=false, HO=false, HH=false),
      AI1CH8Reserved=struct(SF=false, LL=false, LO=false, HO=false, HH=false),
      RBVPDT=struct(SF=false, LL=false, LO=false, HO=false, HH=false),
      RTVPDT=struct(SF=false, LL=false, LO=false, HO=false, HH=false),
      RTVFeedback=struct(SF=false, LL=false, LO=false, HO=false, HH=false),
      AI2CH4Reserved=struct(SF=false, LL=false, LO=false, HO=false, HH=false),
      AI2CH5Reserved=struct(SF=false, LL=false, LO=false, HO=false, HH=false),
      AI2CH6Reserved=struct(SF=false, LL=false, LO=false, HO=false, HH=false),
      AI2CH7Reserved=struct(SF=false, LL=false, LO=false, HO=false, HH=false),
      AI2CH8Reserved=struct(SF=false, LL=false, LO=false, HO=false, HH=false),
      FODosAirInletPress=struct(SF=false, LL=false, LO=false, HO=false, HH=false),
      FODosAirOutletPress=struct(SF=false, LL=false, LO=false, HO=false, HH=false),
      FODosFOInletPress=struct(SF=false, LL=false, LO=false, HO=false, HH=false),
      FODosFOMiddlePress=struct(SF=false, LL=false, LO=false, HO=false, HH=false),
      FODosFOFlowrateFeedback=struct(SF=false, LL=false, LO=false, HO=false, HH=false),
      FODosFOOutletPress=struct(SF=false, LL=false, LO=false, HO=false, HH=false),
      AI3CH7Reserved=struct(SF=false, LL=false, LO=false, HO=false, HH=false),
      AI3CH8Reserved=struct(SF=false, LL=false, LO=false, HO=false, HH=false)),
    IUD=struct(
      CommunicationFailwithAMS=false,
      EGSuddenDieselTransfer=false,
      EGstoppedduringgas=false,
      MSSNormalFail=false,
      TMBTimeout=false,
      RemoteStopWhileTMB=false,
      MOCSNotReady=false,
      RSVFail=false,
      RSVFeedbackSF=false,
      RBVFail=false,
      RBVFeedbackSF=false,
      SCRValveFail=false,
      SCRValveFeedbackSF=false,
      RTVFail=false,
      RTVDev=false,
      DosingFOFlowDev=false,
      DosingFOFlowDevTimeout=false,
      DosingFOLimitSatTimeout=false,
      RTVPDTSFMOCSNotready=false)),
  No5=struct(
    IHD=struct(
      AI1ModuleFault=false,
      AI2ModuleFault=false,
      AI3ModuleFault=false,
      AO1ModuleFault=false,
      DI1ModuleFault=false,
      DO1ModuleFault=false,
      LowSulfurfuelsupplied_H0=struct(DH=false, DL=false),
      MOCSRemoteLocal_HR=struct(DH=false, DL=false),
      MOCSEmcystopFpanel_LE=struct(DH=false, DL=false),
      MOCSEmcystopFECR_LE=struct(DH=false, DL=false),
      MOCSEmcystopFBridge_LE=struct(DH=false, DL=false),
      MOCSStart_HS=struct(DH=false, DL=false),
      MOCSPreparation_HP=struct(DH=false, DL=false),
      MOCSStop_HS=struct(DH=false, DL=false),
      RSVFeedback_HO=struct(DH=false, DL=false),
      RSVFeedback_HC=struct(DH=false, DL=false),
      RBVFeedback_HO=struct(DH=false, DL=false),
      RBVFeedback_HC=struct(DH=false, DL=false),
      FODosFOInletTemp_L=struct(DH=false, DL=false),
      SCRValveFeedback_HO=struct(DH=false, DL=false),
      SCRValveFeedback_HC=struct(DH=false, DL=false),
      DI1CH16Reserved_HC=struct(DH=false, DL=false),
      MixerInletTemp=struct(SF=false, LL=false, LO=false, HO=false, HH=false),
      ChamberInletTemp=struct(SF=false, LL=false, LO=false, HO=false, HH=false),
      ChamberMiddleTemp=struct(SF=false, LL=false, LO=false, HO=false, HH=false),
      ChamberOutletTemp=struct(SF=false, LL=false, LO=false, HO=false, HH=false),
      ChamberDiffPress=struct(SF=false, LL=false, LO=false, HO=false, HH=false),
      VnSAirInletPress=struct(SF=false, LL=false, LO=false, HO=false, HH=false),
      AI1CH7Reserved=struct(SF=false, LL=false, LO=false, HO=false, HH=false),
      AI1CH8Reserved=struct(SF=false, LL=false, LO=false, HO=false, HH=false),
      RBVPDT=struct(SF=false, LL=false, LO=false, HO=false, HH=false),
      RTVPDT=struct(SF=false, LL=false, LO=false, HO=false, HH=false),
      RTVFeedback=struct(SF=false, LL=false, LO=false, HO=false, HH=false),
      AI2CH4Reserved=struct(SF=false, LL=false, LO=false, HO=false, HH=false),
      AI2CH5Reserved=struct(SF=false, LL=false, LO=false, HO=false, HH=false),
      AI2CH6Reserved=struct(SF=false, LL=false, LO=false, HO=false, HH=false),
      AI2CH7Reserved=struct(SF=false, LL=false, LO=false, HO=false, HH=false),
      AI2CH8Reserved=struct(SF=false, LL=false, LO=false, HO=false, HH=false),
      FODosAirInletPress=struct(SF=false, LL=false, LO=false, HO=false, HH=false),
      FODosAirOutletPress=struct(SF=false, LL=false, LO=false, HO=false, HH=false),
      FODosFOInletPress=struct(SF=false, LL=false, LO=false, HO=false, HH=false),
      FODosFOMiddlePress=struct(SF=false, LL=false, LO=false, HO=false, HH=false),
      FODosFOFlowrateFeedback=struct(SF=false, LL=false, LO=false, HO=false, HH=false),
      FODosFOOutletPress=struct(SF=false, LL=false, LO=false, HO=false, HH=false),
      AI3CH7Reserved=struct(SF=false, LL=false, LO=false, HO=false, HH=false),
      AI3CH8Reserved=struct(SF=false, LL=false, LO=false, HO=false, HH=false)),
    IUD=struct(
      CommunicationFailwithAMS=false,
      EGSuddenDieselTransfer=false,
      EGstoppedduringgas=false,
      MSSNormalFail=false,
      TMBTimeout=false,
      RemoteStopWhileTMB=false,
      MOCSNotReady=false,
      RSVFail=false,
      RSVFeedbackSF=false,
      RBVFail=false,
      RBVFeedbackSF=false,
      SCRValveFail=false,
      SCRValveFeedbackSF=false,
      RTVFail=false,
      RTVDev=false,
      DosingFOFlowDev=false,
      DosingFOFlowDevTimeout=false,
      DosingFOLimitSatTimeout=false,
      RTVPDTSFMOCSNotready=false)),
  No6=struct(
    IHD=struct(
      AI1ModuleFault=false,
      AI2ModuleFault=false,
      AI3ModuleFault=false,
      AO1ModuleFault=false,
      DI1ModuleFault=false,
      DO1ModuleFault=false,
      LowSulfurfuelsupplied_H0=struct(DH=false, DL=false),
      MOCSRemoteLocal_HR=struct(DH=false, DL=false),
      MOCSEmcystopFpanel_LE=struct(DH=false, DL=false),
      MOCSEmcystopFECR_LE=struct(DH=false, DL=false),
      MOCSEmcystopFBridge_LE=struct(DH=false, DL=false),
      MOCSStart_HS=struct(DH=false, DL=false),
      MOCSPreparation_HP=struct(DH=false, DL=false),
      MOCSStop_HS=struct(DH=false, DL=false),
      RSVFeedback_HO=struct(DH=false, DL=false),
      RSVFeedback_HC=struct(DH=false, DL=false),
      RBVFeedback_HO=struct(DH=false, DL=false),
      RBVFeedback_HC=struct(DH=false, DL=false),
      FODosFOInletTemp_L=struct(DH=false, DL=false),
      SCRValveFeedback_HO=struct(DH=false, DL=false),
      SCRValveFeedback_HC=struct(DH=false, DL=false),
      DI1CH16Reserved_HC=struct(DH=false, DL=false),
      MixerInletTemp=struct(SF=false, LL=false, LO=false, HO=false, HH=false),
      ChamberInletTemp=struct(SF=false, LL=false, LO=false, HO=false, HH=false),
      ChamberMiddleTemp=struct(SF=false, LL=false, LO=false, HO=false, HH=false),
      ChamberOutletTemp=struct(SF=false, LL=false, LO=false, HO=false, HH=false),
      ChamberDiffPress=struct(SF=false, LL=false, LO=false, HO=false, HH=false),
      VnSAirInletPress=struct(SF=false, LL=false, LO=false, HO=false, HH=false),
      AI1CH7Reserved=struct(SF=false, LL=false, LO=false, HO=false, HH=false),
      AI1CH8Reserved=struct(SF=false, LL=false, LO=false, HO=false, HH=false),
      RBVPDT=struct(SF=false, LL=false, LO=false, HO=false, HH=false),
      RTVPDT=struct(SF=false, LL=false, LO=false, HO=false, HH=false),
      RTVFeedback=struct(SF=false, LL=false, LO=false, HO=false, HH=false),
      AI2CH4Reserved=struct(SF=false, LL=false, LO=false, HO=false, HH=false),
      AI2CH5Reserved=struct(SF=false, LL=false, LO=false, HO=false, HH=false),
      AI2CH6Reserved=struct(SF=false, LL=false, LO=false, HO=false, HH=false),
      AI2CH7Reserved=struct(SF=false, LL=false, LO=false, HO=false, HH=false),
      AI2CH8Reserved=struct(SF=false, LL=false, LO=false, HO=false, HH=false),
      FODosAirInletPress=struct(SF=false, LL=false, LO=false, HO=false, HH=false),
      FODosAirOutletPress=struct(SF=false, LL=false, LO=false, HO=false, HH=false),
      FODosFOInletPress=struct(SF=false, LL=false, LO=false, HO=false, HH=false),
      FODosFOMiddlePress=struct(SF=false, LL=false, LO=false, HO=false, HH=false),
      FODosFOFlowrateFeedback=struct(SF=false, LL=false, LO=false, HO=false, HH=false),
      FODosFOOutletPress=struct(SF=false, LL=false, LO=false, HO=false, HH=false),
      AI3CH7Reserved=struct(SF=false, LL=false, LO=false, HO=false, HH=false),
      AI3CH8Reserved=struct(SF=false, LL=false, LO=false, HO=false, HH=false)),
    IUD=struct(
      CommunicationFailwithAMS=false,
      EGSuddenDieselTransfer=false,
      EGstoppedduringgas=false,
      MSSNormalFail=false,
      TMBTimeout=false,
      RemoteStopWhileTMB=false,
      MOCSNotReady=false,
      RSVFail=false,
      RSVFeedbackSF=false,
      RBVFail=false,
      RBVFeedbackSF=false,
      SCRValveFail=false,
      SCRValveFeedbackSF=false,
      RTVFail=false,
      RTVDev=false,
      DosingFOFlowDev=false,
      DosingFOFlowDevTimeout=false,
      DosingFOLimitSatTimeout=false,
      RTVPDTSFMOCSNotready=false)),
  No7=struct(
    IHD=struct(
      AI1ModuleFault=false,
      AI2ModuleFault=false,
      AI3ModuleFault=false,
      AO1ModuleFault=false,
      DI1ModuleFault=false,
      DO1ModuleFault=false,
      LowSulfurfuelsupplied_H0=struct(DH=false, DL=false),
      MOCSRemoteLocal_HR=struct(DH=false, DL=false),
      MOCSEmcystopFpanel_LE=struct(DH=false, DL=false),
      MOCSEmcystopFECR_LE=struct(DH=false, DL=false),
      MOCSEmcystopFBridge_LE=struct(DH=false, DL=false),
      MOCSStart_HS=struct(DH=false, DL=false),
      MOCSPreparation_HP=struct(DH=false, DL=false),
      MOCSStop_HS=struct(DH=false, DL=false),
      RSVFeedback_HO=struct(DH=false, DL=false),
      RSVFeedback_HC=struct(DH=false, DL=false),
      RBVFeedback_HO=struct(DH=false, DL=false),
      RBVFeedback_HC=struct(DH=false, DL=false),
      FODosFOInletTemp_L=struct(DH=false, DL=false),
      SCRValveFeedback_HO=struct(DH=false, DL=false),
      SCRValveFeedback_HC=struct(DH=false, DL=false),
      DI1CH16Reserved_HC=struct(DH=false, DL=false),
      MixerInletTemp=struct(SF=false, LL=false, LO=false, HO=false, HH=false),
      ChamberInletTemp=struct(SF=false, LL=false, LO=false, HO=false, HH=false),
      ChamberMiddleTemp=struct(SF=false, LL=false, LO=false, HO=false, HH=false),
      ChamberOutletTemp=struct(SF=false, LL=false, LO=false, HO=false, HH=false),
      ChamberDiffPress=struct(SF=false, LL=false, LO=false, HO=false, HH=false),
      VnSAirInletPress=struct(SF=false, LL=false, LO=false, HO=false, HH=false),
      AI1CH7Reserved=struct(SF=false, LL=false, LO=false, HO=false, HH=false),
      AI1CH8Reserved=struct(SF=false, LL=false, LO=false, HO=false, HH=false),
      RBVPDT=struct(SF=false, LL=false, LO=false, HO=false, HH=false),
      RTVPDT=struct(SF=false, LL=false, LO=false, HO=false, HH=false),
      RTVFeedback=struct(SF=false, LL=false, LO=false, HO=false, HH=false),
      AI2CH4Reserved=struct(SF=false, LL=false, LO=false, HO=false, HH=false),
      AI2CH5Reserved=struct(SF=false, LL=false, LO=false, HO=false, HH=false),
      AI2CH6Reserved=struct(SF=false, LL=false, LO=false, HO=false, HH=false),
      AI2CH7Reserved=struct(SF=false, LL=false, LO=false, HO=false, HH=false),
      AI2CH8Reserved=struct(SF=false, LL=false, LO=false, HO=false, HH=false),
      FODosAirInletPress=struct(SF=false, LL=false, LO=false, HO=false, HH=false),
      FODosAirOutletPress=struct(SF=false, LL=false, LO=false, HO=false, HH=false),
      FODosFOInletPress=struct(SF=false, LL=false, LO=false, HO=false, HH=false),
      FODosFOMiddlePress=struct(SF=false, LL=false, LO=false, HO=false, HH=false),
      FODosFOFlowrateFeedback=struct(SF=false, LL=false, LO=false, HO=false, HH=false),
      FODosFOOutletPress=struct(SF=false, LL=false, LO=false, HO=false, HH=false),
      AI3CH7Reserved=struct(SF=false, LL=false, LO=false, HO=false, HH=false),
      AI3CH8Reserved=struct(SF=false, LL=false, LO=false, HO=false, HH=false)),
    IUD=struct(
      CommunicationFailwithAMS=false,
      EGSuddenDieselTransfer=false,
      EGstoppedduringgas=false,
      MSSNormalFail=false,
      TMBTimeout=false,
      RemoteStopWhileTMB=false,
      MOCSNotReady=false,
      RSVFail=false,
      RSVFeedbackSF=false,
      RBVFail=false,
      RBVFeedbackSF=false,
      SCRValveFail=false,
      SCRValveFeedbackSF=false,
      RTVFail=false,
      RTVDev=false,
      DosingFOFlowDev=false,
      DosingFOFlowDevTimeout=false,
      DosingFOLimitSatTimeout=false,
      RTVPDTSFMOCSNotready=false)),
  No8=struct(
    IHD=struct(
      AI1ModuleFault=false,
      AI2ModuleFault=false,
      AI3ModuleFault=false,
      AO1ModuleFault=false,
      DI1ModuleFault=false,
      DO1ModuleFault=false,
      LowSulfurfuelsupplied_H0=struct(DH=false, DL=false),
      MOCSRemoteLocal_HR=struct(DH=false, DL=false),
      MOCSEmcystopFpanel_LE=struct(DH=false, DL=false),
      MOCSEmcystopFECR_LE=struct(DH=false, DL=false),
      MOCSEmcystopFBridge_LE=struct(DH=false, DL=false),
      MOCSStart_HS=struct(DH=false, DL=false),
      MOCSPreparation_HP=struct(DH=false, DL=false),
      MOCSStop_HS=struct(DH=false, DL=false),
      RSVFeedback_HO=struct(DH=false, DL=false),
      RSVFeedback_HC=struct(DH=false, DL=false),
      RBVFeedback_HO=struct(DH=false, DL=false),
      RBVFeedback_HC=struct(DH=false, DL=false),
      FODosFOInletTemp_L=struct(DH=false, DL=false),
      SCRValveFeedback_HO=struct(DH=false, DL=false),
      SCRValveFeedback_HC=struct(DH=false, DL=false),
      DI1CH16Reserved_HC=struct(DH=false, DL=false),
      MixerInletTemp=struct(SF=false, LL=false, LO=false, HO=false, HH=false),
      ChamberInletTemp=struct(SF=false, LL=false, LO=false, HO=false, HH=false),
      ChamberMiddleTemp=struct(SF=false, LL=false, LO=false, HO=false, HH=false),
      ChamberOutletTemp=struct(SF=false, LL=false, LO=false, HO=false, HH=false),
      ChamberDiffPress=struct(SF=false, LL=false, LO=false, HO=false, HH=false),
      VnSAirInletPress=struct(SF=false, LL=false, LO=false, HO=false, HH=false),
      AI1CH7Reserved=struct(SF=false, LL=false, LO=false, HO=false, HH=false),
      AI1CH8Reserved=struct(SF=false, LL=false, LO=false, HO=false, HH=false),
      RBVPDT=struct(SF=false, LL=false, LO=false, HO=false, HH=false),
      RTVPDT=struct(SF=false, LL=false, LO=false, HO=false, HH=false),
      RTVFeedback=struct(SF=false, LL=false, LO=false, HO=false, HH=false),
      AI2CH4Reserved=struct(SF=false, LL=false, LO=false, HO=false, HH=false),
      AI2CH5Reserved=struct(SF=false, LL=false, LO=false, HO=false, HH=false),
      AI2CH6Reserved=struct(SF=false, LL=false, LO=false, HO=false, HH=false),
      AI2CH7Reserved=struct(SF=false, LL=false, LO=false, HO=false, HH=false),
      AI2CH8Reserved=struct(SF=false, LL=false, LO=false, HO=false, HH=false),
      FODosAirInletPress=struct(SF=false, LL=false, LO=false, HO=false, HH=false),
      FODosAirOutletPress=struct(SF=false, LL=false, LO=false, HO=false, HH=false),
      FODosFOInletPress=struct(SF=false, LL=false, LO=false, HO=false, HH=false),
      FODosFOMiddlePress=struct(SF=false, LL=false, LO=false, HO=false, HH=false),
      FODosFOFlowrateFeedback=struct(SF=false, LL=false, LO=false, HO=false, HH=false),
      FODosFOOutletPress=struct(SF=false, LL=false, LO=false, HO=false, HH=false),
      AI3CH7Reserved=struct(SF=false, LL=false, LO=false, HO=false, HH=false),
      AI3CH8Reserved=struct(SF=false, LL=false, LO=false, HO=false, HH=false)),
    IUD=struct(
      CommunicationFailwithAMS=false,
      EGSuddenDieselTransfer=false,
      EGstoppedduringgas=false,
      MSSNormalFail=false,
      TMBTimeout=false,
      RemoteStopWhileTMB=false,
      MOCSNotReady=false,
      RSVFail=false,
      RSVFeedbackSF=false,
      RBVFail=false,
      RBVFeedbackSF=false,
      SCRValveFail=false,
      SCRValveFeedbackSF=false,
      RTVFail=false,
      RTVDev=false,
      DosingFOFlowDev=false,
      DosingFOFlowDevTimeout=false,
      DosingFOLimitSatTimeout=false,
      RTVPDTSFMOCSNotready=false)))

CUD_typ = Simulink.Bus()
  CommunicationFailwithHMI: boolean
  No1FOsupplypumpFail: boolean
  No2FOsupplypumpFail: boolean

CUD_typ_s = struct(CommunicationFailwithHMI=false, No1FOsupplypumpFail=false, No2FOsupplypumpFail=false)

CommAlarm_typ = Simulink.Bus()
  CHD: Bus: CHD_typ
  CUD: Bus: CUD_typ

CommAlarm_typ_s = struct(
  CHD=struct(
    CommonAI1ModuleFault=false,
    CommonDI1ModuleFault=false,
    CommonDO1ModuleFault=false,
    FOpumpAutomode_HA=struct(DH=false, DL=false),
    AlarmReset_HR=struct(DH=false, DL=false),
    LCpowerFail_LF=struct(DH=false, DL=false),
    InternalpowerFail_LF=struct(DH=false, DL=false),
    ExternalpowerFail_LF=struct(DH=false, DL=false),
    FanpowerFail_LF=struct(DH=false, DL=false),
    ESDcircuitpowerFail_LF=struct(DH=false, DL=false),
    No1FOpumpRemote_HR=struct(DH=false, DL=false),
    No1FOpumpAbnormal_LA=struct(DH=false, DL=false),
    No1FOpumpRunning_HR=struct(DH=false, DL=false),
    No2FOpumpRemote_HR=struct(DH=false, DL=false),
    No2FOpumpAbnormal_LA=struct(DH=false, DL=false),
    No2FOpumpRunning_HR=struct(DH=false, DL=false),
    CDI1CH14Reserved_HR=struct(DH=false, DL=false),
    CDI1CH15Reserved_HR=struct(DH=false, DL=false),
    CDI1CH16Reserved_HR=struct(DH=false, DL=false),
    FOSupplyInletPress=struct(SF=false, LL=false, LO=false, HO=false, HH=false),
    FOSupplyOutletPress=struct(SF=false, LL=false, LO=false, HO=false, HH=false),
    CAI1CH3Reserved=struct(SF=false, LL=false, LO=false, HO=false, HH=false),
    CAI1CH4Reserved=struct(SF=false, LL=false, LO=false, HO=false, HH=false),
    CAI1CH5Reserved=struct(SF=false, LL=false, LO=false, HO=false, HH=false),
    CAI1CH6Reserved=struct(SF=false, LL=false, LO=false, HO=false, HH=false),
    CAI1CH7Reserved=struct(SF=false, LL=false, LO=false, HO=false, HH=false),
    CAI1CH8Reserved=struct(SF=false, LL=false, LO=false, HO=false, HH=false)),
  CUD=struct(CommunicationFailwithHMI=false, No1FOsupplypumpFail=false, No2FOsupplypumpFail=false))

IHD_typ = Simulink.Bus()
  AI1ModuleFault: boolean
  AI2ModuleFault: boolean
  AI3ModuleFault: boolean
  AO1ModuleFault: boolean
  DI1ModuleFault: boolean
  DO1ModuleFault: boolean
  LowSulfurfuelsupplied_H0: Bus: DIAlarm_typ
  MOCSRemoteLocal_HR: Bus: DIAlarm_typ
  MOCSEmcystopFpanel_LE: Bus: DIAlarm_typ
  MOCSEmcystopFECR_LE: Bus: DIAlarm_typ
  MOCSEmcystopFBridge_LE: Bus: DIAlarm_typ
  MOCSStart_HS: Bus: DIAlarm_typ
  MOCSPreparation_HP: Bus: DIAlarm_typ
  MOCSStop_HS: Bus: DIAlarm_typ
  RSVFeedback_HO: Bus: DIAlarm_typ
  RSVFeedback_HC: Bus: DIAlarm_typ
  RBVFeedback_HO: Bus: DIAlarm_typ
  RBVFeedback_HC: Bus: DIAlarm_typ
  FODosFOInletTemp_L: Bus: DIAlarm_typ
  SCRValveFeedback_HO: Bus: DIAlarm_typ
  SCRValveFeedback_HC: Bus: DIAlarm_typ
  DI1CH16Reserved_HC: Bus: DIAlarm_typ
  MixerInletTemp: Bus: AIAlarm_typ
  ChamberInletTemp: Bus: AIAlarm_typ
  ChamberMiddleTemp: Bus: AIAlarm_typ
  ChamberOutletTemp: Bus: AIAlarm_typ
  ChamberDiffPress: Bus: AIAlarm_typ
  VnSAirInletPress: Bus: AIAlarm_typ
  AI1CH7Reserved: Bus: AIAlarm_typ
  AI1CH8Reserved: Bus: AIAlarm_typ
  RBVPDT: Bus: AIAlarm_typ
  RTVPDT: Bus: AIAlarm_typ
  RTVFeedback: Bus: AIAlarm_typ
  AI2CH4Reserved: Bus: AIAlarm_typ
  AI2CH5Reserved: Bus: AIAlarm_typ
  AI2CH6Reserved: Bus: AIAlarm_typ
  AI2CH7Reserved: Bus: AIAlarm_typ
  AI2CH8Reserved: Bus: AIAlarm_typ
  FODosAirInletPress: Bus: AIAlarm_typ
  FODosAirOutletPress: Bus: AIAlarm_typ
  FODosFOInletPress: Bus: AIAlarm_typ
  FODosFOMiddlePress: Bus: AIAlarm_typ
  FODosFOFlowrateFeedback: Bus: AIAlarm_typ
  FODosFOOutletPress: Bus: AIAlarm_typ
  AI3CH7Reserved: Bus: AIAlarm_typ
  AI3CH8Reserved: Bus: AIAlarm_typ

IUD_typ = Simulink.Bus()
  CommunicationFailwithAMS: boolean
  EGSuddenDieselTransfer: boolean
  EGstoppedduringgas: boolean
  MSSNormalFail: boolean
  TMBTimeout: boolean
  RemoteStopWhileTMB: boolean
  MOCSNotReady: boolean
  RSVFail: boolean
  RSVFeedbackSF: boolean
  RBVFail: boolean
  RBVFeedbackSF: boolean
  SCRValveFail: boolean
  SCRValveFeedbackSF: boolean
  RTVFail: boolean
  RTVDev: boolean
  DosingFOFlowDev: boolean
  DosingFOFlowDevTimeout: boolean
  DosingFOLimitSatTimeout: boolean
  RTVPDTSFMOCSNotready: boolean

IndivAlarm_typ = Simulink.Bus()
  IHD: Bus: IHD_typ
  IUD: Bus: IUD_typ

IndivAlarm_typ_s = struct(
  IHD=struct(
    AI1ModuleFault=false,
    AI2ModuleFault=false,
    AI3ModuleFault=false,
    AO1ModuleFault=false,
    DI1ModuleFault=false,
    DO1ModuleFault=false,
    LowSulfurfuelsupplied_H0=struct(DH=false, DL=false),
    MOCSRemoteLocal_HR=struct(DH=false, DL=false),
    MOCSEmcystopFpanel_LE=struct(DH=false, DL=false),
    MOCSEmcystopFECR_LE=struct(DH=false, DL=false),
    MOCSEmcystopFBridge_LE=struct(DH=false, DL=false),
    MOCSStart_HS=struct(DH=false, DL=false),
    MOCSPreparation_HP=struct(DH=false, DL=false),
    MOCSStop_HS=struct(DH=false, DL=false),
    RSVFeedback_HO=struct(DH=false, DL=false),
    RSVFeedback_HC=struct(DH=false, DL=false),
    RBVFeedback_HO=struct(DH=false, DL=false),
    RBVFeedback_HC=struct(DH=false, DL=false),
    FODosFOInletTemp_L=struct(DH=false, DL=false),
    SCRValveFeedback_HO=struct(DH=false, DL=false),
    SCRValveFeedback_HC=struct(DH=false, DL=false),
    DI1CH16Reserved_HC=struct(DH=false, DL=false),
    MixerInletTemp=struct(SF=false, LL=false, LO=false, HO=false, HH=false),
    ChamberInletTemp=struct(SF=false, LL=false, LO=false, HO=false, HH=false),
    ChamberMiddleTemp=struct(SF=false, LL=false, LO=false, HO=false, HH=false),
    ChamberOutletTemp=struct(SF=false, LL=false, LO=false, HO=false, HH=false),
    ChamberDiffPress=struct(SF=false, LL=false, LO=false, HO=false, HH=false),
    VnSAirInletPress=struct(SF=false, LL=false, LO=false, HO=false, HH=false),
    AI1CH7Reserved=struct(SF=false, LL=false, LO=false, HO=false, HH=false),
    AI1CH8Reserved=struct(SF=false, LL=false, LO=false, HO=false, HH=false),
    RBVPDT=struct(SF=false, LL=false, LO=false, HO=false, HH=false),
    RTVPDT=struct(SF=false, LL=false, LO=false, HO=false, HH=false),
    RTVFeedback=struct(SF=false, LL=false, LO=false, HO=false, HH=false),
    AI2CH4Reserved=struct(SF=false, LL=false, LO=false, HO=false, HH=false),
    AI2CH5Reserved=struct(SF=false, LL=false, LO=false, HO=false, HH=false),
    AI2CH6Reserved=struct(SF=false, LL=false, LO=false, HO=false, HH=false),
    AI2CH7Reserved=struct(SF=false, LL=false, LO=false, HO=false, HH=false),
    AI2CH8Reserved=struct(SF=false, LL=false, LO=false, HO=false, HH=false),
    FODosAirInletPress=struct(SF=false, LL=false, LO=false, HO=false, HH=false),
    FODosAirOutletPress=struct(SF=false, LL=false, LO=false, HO=false, HH=false),
    FODosFOInletPress=struct(SF=false, LL=false, LO=false, HO=false, HH=false),
    FODosFOMiddlePress=struct(SF=false, LL=false, LO=false, HO=false, HH=false),
    FODosFOFlowrateFeedback=struct(SF=false, LL=false, LO=false, HO=false, HH=false),
    FODosFOOutletPress=struct(SF=false, LL=false, LO=false, HO=false, HH=false),
    AI3CH7Reserved=struct(SF=false, LL=false, LO=false, HO=false, HH=false),
    AI3CH8Reserved=struct(SF=false, LL=false, LO=false, HO=false, HH=false)),
  IUD=struct(
    CommunicationFailwithAMS=false,
    EGSuddenDieselTransfer=false,
    EGstoppedduringgas=false,
    MSSNormalFail=false,
    TMBTimeout=false,
    RemoteStopWhileTMB=false,
    MOCSNotReady=false,
    RSVFail=false,
    RSVFeedbackSF=false,
    RBVFail=false,
    RBVFeedbackSF=false,
    SCRValveFail=false,
    SCRValveFeedbackSF=false,
    RTVFail=false,
    RTVDev=false,
    DosingFOFlowDev=false,
    DosingFOFlowDevTimeout=false,
    DosingFOLimitSatTimeout=false,
    RTVPDTSFMOCSNotready=false))

Alarm_typ = Simulink.Bus()
  Comm: Bus: CommAlarm_typ
  No1: Bus: IndivAlarm_typ
  No2: Bus: IndivAlarm_typ
  No3: Bus: IndivAlarm_typ
  No4: Bus: IndivAlarm_typ
  No5: Bus: IndivAlarm_typ
  No6: Bus: IndivAlarm_typ
  No7: Bus: IndivAlarm_typ
  No8: Bus: IndivAlarm_typ

CAI_typ = Simulink.Bus()
  FOSupplyInletPress: single
  FOSupplyOutletPress: single
  CAI1Reserved3: single
  CAI1Reserved4: single
  CAI1Reserved5: single
  CAI1Reserved6: single
  CAI1Reserved7: single
  CAI1Reserved8: single

CAI_typ_s = struct(
  FOSupplyInletPress=single(0),
  FOSupplyOutletPress=single(0),
  CAI1Reserved3=single(0),
  CAI1Reserved4=single(0),
  CAI1Reserved5=single(0),
  CAI1Reserved6=single(0),
  CAI1Reserved7=single(0),
  CAI1Reserved8=single(0))

CDI_typ = Simulink.Bus()
  FOSupplypumpAutomode: boolean
  AlarmReset: boolean
  PLCpowerFail_Reserved: boolean
  InternalpowerFail: boolean
  ExternalpowerFail: boolean
  FanpowerFail: boolean
  ESDcircuitpowerFail: boolean
  No1FOSupplypumpRemote: boolean
  No1FOSupplypumpAbnormal: boolean
  No1FOSupplypumpRunning: boolean
  No2FOSupplypumpRemote: boolean
  No2FOSupplypumpAbnormal: boolean
  No2FOSupplypumpRunning: boolean
  fromYardFOSupplypumpRunning: boolean
  CDI1Reserved15: boolean
  CDI1Reserved16: boolean

IF_MATIN_IO = struct(
  Comm=struct(
    CAI=struct(
      FOSupplyInletPress=single(0),
      FOSupplyOutletPress=single(0),
      CAI1Reserved3=single(0),
      CAI1Reserved4=single(0),
      CAI1Reserved5=single(0),
      CAI1Reserved6=single(0),
      CAI1Reserved7=single(0),
      CAI1Reserved8=single(0)),
    CDI=struct(
      FOSupplypumpAutomode=false,
      AlarmReset=false,
      PLCpowerFail_Reserved=false,
      InternalpowerFail=false,
      ExternalpowerFail=false,
      FanpowerFail=false,
      ESDcircuitpowerFail=false,
      No1FOSupplypumpRemote=false,
      No1FOSupplypumpAbnormal=false,
      No1FOSupplypumpRunning=false,
      No2FOSupplypumpRemote=false,
      No2FOSupplypumpAbnormal=false,
      No2FOSupplypumpRunning=false,
      fromYardFOSupplypumpRunning=false,
      CDI1Reserved15=false,
      CDI1Reserved16=false),
    CDO=struct(
      MOCSCommonAlarm=false,
      MOCSCommonAlarmLamp=false,
      MOCSCommonAlarmBuzzer=false,
      No1FOSupplypumpRunCommand=false,
      No2FOSupplypumpRunCommand=false,
      toYardFOSupplypumpRunRequest=false,
      toYardFOSupplypumpFail=false,
      CDO1Reserved8=false,
      CDO1Reserved9=false,
      CDO1Reserved10=false,
      CDO1Reserved11=false,
      CDO1Reserved12=false,
      CDO1Reserved13=false,
      CDO1Reserved14=false,
      CDO1Reserved15=false,
      CDO1Reserved16=false)),
  No1=struct(
    IAI=struct(
      MixerInletTemp=single(0),
      ChamberInletTemp=single(0),
      ChamberMiddleTemp=single(0),
      ChamberOutletTemp=single(0),
      ChamberDiffPress=single(0),
      VentingSealingAirInletPress=single(0),
      IAI1Reserved7=single(0),
      IAI1Reserved8=single(0),
      RBVPDT=single(0),
      RTVPDT=single(0),
      RTVFeedback=single(0),
      IAI2Reserved4=single(0),
      IAI2Reserved5=single(0),
      IAI2Reserved6=single(0),
      IAI2Reserved7=single(0),
      IAI2Reserved8=single(0),
      FODAtomizingAirInletPress=single(0),
      FODAtomizingAirOutletPress=single(0),
      FODFuelOilInletPress=single(0),
      FODFuelOilMiddlePress=single(0),
      FODFuelOilFlowrate_Feedback=single(0),
      FODFuelOilOutletPress=single(0),
      IAI3Reserved7=single(0),
      IAI3Reserved8=single(0)),
    IDI=struct(
      GELowSulfurfuelsupplied=false,
      MOCSRemoteLocal=false,
      MOCSEmcystopFrompanel=false,
      MOCSEmcystopFromECR=false,
      MOCSEmcystopFromBridge=false,
      MOCSStart=false,
      MOCSPreparation=false,
      MOCSStop=false,
      RSVFeedback_Open=false,
      RSVFeedback_Closed=false,
      RBVFeedback_Open=false,
      RBVFeedback_Closed=false,
      FODFuelOilInletTemp=false,
      SCRValveFeedback_Open=false,
      SCRValveFeedback_Close=false,
      IDI1Reserved16=false),
    IAO=struct(
      FODFuelOilControlVV_Setpoint=single(0),
      RTVSetpoint=single(0),
      IAO1Reserved3=single(0),
      IAO1Reserved4=single(0)),
    IDO=struct(
      MOCSReady=false,
      AllFlowThroughMOCS=false,
      MOCSActive=false,
      MOCSFODsystemFlushRun=false,
      FODAtomizingAirSolVV=false,
      FODPurgingAirSolVV=false,
      FODFuelOilInletSolVV=false,
      FODFuelOilOutletSolVV=false,
      FODFuelOilReturnSolVV=false,
      RSVSetpoint=false,
      RBVSetpoint=false,
      VentingSealingSolVV=false,
      SCRValveSetpoint=false,
      IDO1Reserved14=false,
      IDO1Reserved15=false,
      IDO1Reserved16=false)),
  No2=struct(
    IAI=struct(
      MixerInletTemp=single(0),
      ChamberInletTemp=single(0),
      ChamberMiddleTemp=single(0),
      ChamberOutletTemp=single(0),
      ChamberDiffPress=single(0),
      VentingSealingAirInletPress=single(0),
      IAI1Reserved7=single(0),
      IAI1Reserved8=single(0),
      RBVPDT=single(0),
      RTVPDT=single(0),
      RTVFeedback=single(0),
      IAI2Reserved4=single(0),
      IAI2Reserved5=single(0),
      IAI2Reserved6=single(0),
      IAI2Reserved7=single(0),
      IAI2Reserved8=single(0),
      FODAtomizingAirInletPress=single(0),
      FODAtomizingAirOutletPress=single(0),
      FODFuelOilInletPress=single(0),
      FODFuelOilMiddlePress=single(0),
      FODFuelOilFlowrate_Feedback=single(0),
      FODFuelOilOutletPress=single(0),
      IAI3Reserved7=single(0),
      IAI3Reserved8=single(0)),
    IDI=struct(
      GELowSulfurfuelsupplied=false,
      MOCSRemoteLocal=false,
      MOCSEmcystopFrompanel=false,
      MOCSEmcystopFromECR=false,
      MOCSEmcystopFromBridge=false,
      MOCSStart=false,
      MOCSPreparation=false,
      MOCSStop=false,
      RSVFeedback_Open=false,
      RSVFeedback_Closed=false,
      RBVFeedback_Open=false,
      RBVFeedback_Closed=false,
      FODFuelOilInletTemp=false,
      SCRValveFeedback_Open=false,
      SCRValveFeedback_Close=false,
      IDI1Reserved16=false),
    IAO=struct(
      FODFuelOilControlVV_Setpoint=single(0),
      RTVSetpoint=single(0),
      IAO1Reserved3=single(0),
      IAO1Reserved4=single(0)),
    IDO=struct(
      MOCSReady=false,
      AllFlowThroughMOCS=false,
      MOCSActive=false,
      MOCSFODsystemFlushRun=false,
      FODAtomizingAirSolVV=false,
      FODPurgingAirSolVV=false,
      FODFuelOilInletSolVV=false,
      FODFuelOilOutletSolVV=false,
      FODFuelOilReturnSolVV=false,
      RSVSetpoint=false,
      RBVSetpoint=false,
      VentingSealingSolVV=false,
      SCRValveSetpoint=false,
      IDO1Reserved14=false,
      IDO1Reserved15=false,
      IDO1Reserved16=false)),
  No3=struct(
    IAI=struct(
      MixerInletTemp=single(0),
      ChamberInletTemp=single(0),
      ChamberMiddleTemp=single(0),
      ChamberOutletTemp=single(0),
      ChamberDiffPress=single(0),
      VentingSealingAirInletPress=single(0),
      IAI1Reserved7=single(0),
      IAI1Reserved8=single(0),
      RBVPDT=single(0),
      RTVPDT=single(0),
      RTVFeedback=single(0),
      IAI2Reserved4=single(0),
      IAI2Reserved5=single(0),
      IAI2Reserved6=single(0),
      IAI2Reserved7=single(0),
      IAI2Reserved8=single(0),
      FODAtomizingAirInletPress=single(0),
      FODAtomizingAirOutletPress=single(0),
      FODFuelOilInletPress=single(0),
      FODFuelOilMiddlePress=single(0),
      FODFuelOilFlowrate_Feedback=single(0),
      FODFuelOilOutletPress=single(0),
      IAI3Reserved7=single(0),
      IAI3Reserved8=single(0)),
    IDI=struct(
      GELowSulfurfuelsupplied=false,
      MOCSRemoteLocal=false,
      MOCSEmcystopFrompanel=false,
      MOCSEmcystopFromECR=false,
      MOCSEmcystopFromBridge=false,
      MOCSStart=false,
      MOCSPreparation=false,
      MOCSStop=false,
      RSVFeedback_Open=false,
      RSVFeedback_Closed=false,
      RBVFeedback_Open=false,
      RBVFeedback_Closed=false,
      FODFuelOilInletTemp=false,
      SCRValveFeedback_Open=false,
      SCRValveFeedback_Close=false,
      IDI1Reserved16=false),
    IAO=struct(
      FODFuelOilControlVV_Setpoint=single(0),
      RTVSetpoint=single(0),
      IAO1Reserved3=single(0),
      IAO1Reserved4=single(0)),
    IDO=struct(
      MOCSReady=false,
      AllFlowThroughMOCS=false,
      MOCSActive=false,
      MOCSFODsystemFlushRun=false,
      FODAtomizingAirSolVV=false,
      FODPurgingAirSolVV=false,
      FODFuelOilInletSolVV=false,
      FODFuelOilOutletSolVV=false,
      FODFuelOilReturnSolVV=false,
      RSVSetpoint=false,
      RBVSetpoint=false,
      VentingSealingSolVV=false,
      SCRValveSetpoint=false,
      IDO1Reserved14=false,
      IDO1Reserved15=false,
      IDO1Reserved16=false)),
  No4=struct(
    IAI=struct(
      MixerInletTemp=single(0),
      ChamberInletTemp=single(0),
      ChamberMiddleTemp=single(0),
      ChamberOutletTemp=single(0),
      ChamberDiffPress=single(0),
      VentingSealingAirInletPress=single(0),
      IAI1Reserved7=single(0),
      IAI1Reserved8=single(0),
      RBVPDT=single(0),
      RTVPDT=single(0),
      RTVFeedback=single(0),
      IAI2Reserved4=single(0),
      IAI2Reserved5=single(0),
      IAI2Reserved6=single(0),
      IAI2Reserved7=single(0),
      IAI2Reserved8=single(0),
      FODAtomizingAirInletPress=single(0),
      FODAtomizingAirOutletPress=single(0),
      FODFuelOilInletPress=single(0),
      FODFuelOilMiddlePress=single(0),
      FODFuelOilFlowrate_Feedback=single(0),
      FODFuelOilOutletPress=single(0),
      IAI3Reserved7=single(0),
      IAI3Reserved8=single(0)),
    IDI=struct(
      GELowSulfurfuelsupplied=false,
      MOCSRemoteLocal=false,
      MOCSEmcystopFrompanel=false,
      MOCSEmcystopFromECR=false,
      MOCSEmcystopFromBridge=false,
      MOCSStart=false,
      MOCSPreparation=false,
      MOCSStop=false,
      RSVFeedback_Open=false,
      RSVFeedback_Closed=false,
      RBVFeedback_Open=false,
      RBVFeedback_Closed=false,
      FODFuelOilInletTemp=false,
      SCRValveFeedback_Open=false,
      SCRValveFeedback_Close=false,
      IDI1Reserved16=false),
    IAO=struct(
      FODFuelOilControlVV_Setpoint=single(0),
      RTVSetpoint=single(0),
      IAO1Reserved3=single(0),
      IAO1Reserved4=single(0)),
    IDO=struct(
      MOCSReady=false,
      AllFlowThroughMOCS=false,
      MOCSActive=false,
      MOCSFODsystemFlushRun=false,
      FODAtomizingAirSolVV=false,
      FODPurgingAirSolVV=false,
      FODFuelOilInletSolVV=false,
      FODFuelOilOutletSolVV=false,
      FODFuelOilReturnSolVV=false,
      RSVSetpoint=false,
      RBVSetpoint=false,
      VentingSealingSolVV=false,
      SCRValveSetpoint=false,
      IDO1Reserved14=false,
      IDO1Reserved15=false,
      IDO1Reserved16=false)),
  No5=struct(
    IAI=struct(
      MixerInletTemp=single(0),
      ChamberInletTemp=single(0),
      ChamberMiddleTemp=single(0),
      ChamberOutletTemp=single(0),
      ChamberDiffPress=single(0),
      VentingSealingAirInletPress=single(0),
      IAI1Reserved7=single(0),
      IAI1Reserved8=single(0),
      RBVPDT=single(0),
      RTVPDT=single(0),
      RTVFeedback=single(0),
      IAI2Reserved4=single(0),
      IAI2Reserved5=single(0),
      IAI2Reserved6=single(0),
      IAI2Reserved7=single(0),
      IAI2Reserved8=single(0),
      FODAtomizingAirInletPress=single(0),
      FODAtomizingAirOutletPress=single(0),
      FODFuelOilInletPress=single(0),
      FODFuelOilMiddlePress=single(0),
      FODFuelOilFlowrate_Feedback=single(0),
      FODFuelOilOutletPress=single(0),
      IAI3Reserved7=single(0),
      IAI3Reserved8=single(0)),
    IDI=struct(
      GELowSulfurfuelsupplied=false,
      MOCSRemoteLocal=false,
      MOCSEmcystopFrompanel=false,
      MOCSEmcystopFromECR=false,
      MOCSEmcystopFromBridge=false,
      MOCSStart=false,
      MOCSPreparation=false,
      MOCSStop=false,
      RSVFeedback_Open=false,
      RSVFeedback_Closed=false,
      RBVFeedback_Open=false,
      RBVFeedback_Closed=false,
      FODFuelOilInletTemp=false,
      SCRValveFeedback_Open=false,
      SCRValveFeedback_Close=false,
      IDI1Reserved16=false),
    IAO=struct(
      FODFuelOilControlVV_Setpoint=single(0),
      RTVSetpoint=single(0),
      IAO1Reserved3=single(0),
      IAO1Reserved4=single(0)),
    IDO=struct(
      MOCSReady=false,
      AllFlowThroughMOCS=false,
      MOCSActive=false,
      MOCSFODsystemFlushRun=false,
      FODAtomizingAirSolVV=false,
      FODPurgingAirSolVV=false,
      FODFuelOilInletSolVV=false,
      FODFuelOilOutletSolVV=false,
      FODFuelOilReturnSolVV=false,
      RSVSetpoint=false,
      RBVSetpoint=false,
      VentingSealingSolVV=false,
      SCRValveSetpoint=false,
      IDO1Reserved14=false,
      IDO1Reserved15=false,
      IDO1Reserved16=false)),
  No6=struct(
    IAI=struct(
      MixerInletTemp=single(0),
      ChamberInletTemp=single(0),
      ChamberMiddleTemp=single(0),
      ChamberOutletTemp=single(0),
      ChamberDiffPress=single(0),
      VentingSealingAirInletPress=single(0),
      IAI1Reserved7=single(0),
      IAI1Reserved8=single(0),
      RBVPDT=single(0),
      RTVPDT=single(0),
      RTVFeedback=single(0),
      IAI2Reserved4=single(0),
      IAI2Reserved5=single(0),
      IAI2Reserved6=single(0),
      IAI2Reserved7=single(0),
      IAI2Reserved8=single(0),
      FODAtomizingAirInletPress=single(0),
      FODAtomizingAirOutletPress=single(0),
      FODFuelOilInletPress=single(0),
      FODFuelOilMiddlePress=single(0),
      FODFuelOilFlowrate_Feedback=single(0),
      FODFuelOilOutletPress=single(0),
      IAI3Reserved7=single(0),
      IAI3Reserved8=single(0)),
    IDI=struct(
      GELowSulfurfuelsupplied=false,
      MOCSRemoteLocal=false,
      MOCSEmcystopFrompanel=false,
      MOCSEmcystopFromECR=false,
      MOCSEmcystopFromBridge=false,
      MOCSStart=false,
      MOCSPreparation=false,
      MOCSStop=false,
      RSVFeedback_Open=false,
      RSVFeedback_Closed=false,
      RBVFeedback_Open=false,
      RBVFeedback_Closed=false,
      FODFuelOilInletTemp=false,
      SCRValveFeedback_Open=false,
      SCRValveFeedback_Close=false,
      IDI1Reserved16=false),
    IAO=struct(
      FODFuelOilControlVV_Setpoint=single(0),
      RTVSetpoint=single(0),
      IAO1Reserved3=single(0),
      IAO1Reserved4=single(0)),
    IDO=struct(
      MOCSReady=false,
      AllFlowThroughMOCS=false,
      MOCSActive=false,
      MOCSFODsystemFlushRun=false,
      FODAtomizingAirSolVV=false,
      FODPurgingAirSolVV=false,
      FODFuelOilInletSolVV=false,
      FODFuelOilOutletSolVV=false,
      FODFuelOilReturnSolVV=false,
      RSVSetpoint=false,
      RBVSetpoint=false,
      VentingSealingSolVV=false,
      SCRValveSetpoint=false,
      IDO1Reserved14=false,
      IDO1Reserved15=false,
      IDO1Reserved16=false)),
  No7=struct(
    IAI=struct(
      MixerInletTemp=single(0),
      ChamberInletTemp=single(0),
      ChamberMiddleTemp=single(0),
      ChamberOutletTemp=single(0),
      ChamberDiffPress=single(0),
      VentingSealingAirInletPress=single(0),
      IAI1Reserved7=single(0),
      IAI1Reserved8=single(0),
      RBVPDT=single(0),
      RTVPDT=single(0),
      RTVFeedback=single(0),
      IAI2Reserved4=single(0),
      IAI2Reserved5=single(0),
      IAI2Reserved6=single(0),
      IAI2Reserved7=single(0),
      IAI2Reserved8=single(0),
      FODAtomizingAirInletPress=single(0),
      FODAtomizingAirOutletPress=single(0),
      FODFuelOilInletPress=single(0),
      FODFuelOilMiddlePress=single(0),
      FODFuelOilFlowrate_Feedback=single(0),
      FODFuelOilOutletPress=single(0),
      IAI3Reserved7=single(0),
      IAI3Reserved8=single(0)),
    IDI=struct(
      GELowSulfurfuelsupplied=false,
      MOCSRemoteLocal=false,
      MOCSEmcystopFrompanel=false,
      MOCSEmcystopFromECR=false,
      MOCSEmcystopFromBridge=false,
      MOCSStart=false,
      MOCSPreparation=false,
      MOCSStop=false,
      RSVFeedback_Open=false,
      RSVFeedback_Closed=false,
      RBVFeedback_Open=false,
      RBVFeedback_Closed=false,
      FODFuelOilInletTemp=false,
      SCRValveFeedback_Open=false,
      SCRValveFeedback_Close=false,
      IDI1Reserved16=false),
    IAO=struct(
      FODFuelOilControlVV_Setpoint=single(0),
      RTVSetpoint=single(0),
      IAO1Reserved3=single(0),
      IAO1Reserved4=single(0)),
    IDO=struct(
      MOCSReady=false,
      AllFlowThroughMOCS=false,
      MOCSActive=false,
      MOCSFODsystemFlushRun=false,
      FODAtomizingAirSolVV=false,
      FODPurgingAirSolVV=false,
      FODFuelOilInletSolVV=false,
      FODFuelOilOutletSolVV=false,
      FODFuelOilReturnSolVV=false,
      RSVSetpoint=false,
      RBVSetpoint=false,
      VentingSealingSolVV=false,
      SCRValveSetpoint=false,
      IDO1Reserved14=false,
      IDO1Reserved15=false,
      IDO1Reserved16=false)),
  No8=struct(
    IAI=struct(
      MixerInletTemp=single(0),
      ChamberInletTemp=single(0),
      ChamberMiddleTemp=single(0),
      ChamberOutletTemp=single(0),
      ChamberDiffPress=single(0),
      VentingSealingAirInletPress=single(0),
      IAI1Reserved7=single(0),
      IAI1Reserved8=single(0),
      RBVPDT=single(0),
      RTVPDT=single(0),
      RTVFeedback=single(0),
      IAI2Reserved4=single(0),
      IAI2Reserved5=single(0),
      IAI2Reserved6=single(0),
      IAI2Reserved7=single(0),
      IAI2Reserved8=single(0),
      FODAtomizingAirInletPress=single(0),
      FODAtomizingAirOutletPress=single(0),
      FODFuelOilInletPress=single(0),
      FODFuelOilMiddlePress=single(0),
      FODFuelOilFlowrate_Feedback=single(0),
      FODFuelOilOutletPress=single(0),
      IAI3Reserved7=single(0),
      IAI3Reserved8=single(0)),
    IDI=struct(
      GELowSulfurfuelsupplied=false,
      MOCSRemoteLocal=false,
      MOCSEmcystopFrompanel=false,
      MOCSEmcystopFromECR=false,
      MOCSEmcystopFromBridge=false,
      MOCSStart=false,
      MOCSPreparation=false,
      MOCSStop=false,
      RSVFeedback_Open=false,
      RSVFeedback_Closed=false,
      RBVFeedback_Open=false,
      RBVFeedback_Closed=false,
      FODFuelOilInletTemp=false,
      SCRValveFeedback_Open=false,
      SCRValveFeedback_Close=false,
      IDI1Reserved16=false),
    IAO=struct(
      FODFuelOilControlVV_Setpoint=single(0),
      RTVSetpoint=single(0),
      IAO1Reserved3=single(0),
      IAO1Reserved4=single(0)),
    IDO=struct(
      MOCSReady=false,
      AllFlowThroughMOCS=false,
      MOCSActive=false,
      MOCSFODsystemFlushRun=false,
      FODAtomizingAirSolVV=false,
      FODPurgingAirSolVV=false,
      FODFuelOilInletSolVV=false,
      FODFuelOilOutletSolVV=false,
      FODFuelOilReturnSolVV=false,
      RSVSetpoint=false,
      RBVSetpoint=false,
      VentingSealingSolVV=false,
      SCRValveSetpoint=false,
      IDO1Reserved14=false,
      IDO1Reserved15=false,
      IDO1Reserved16=false)))

CDO_typ = Simulink.Bus()
  MOCSCommonAlarm: boolean
  MOCSCommonAlarmLamp: boolean
  MOCSCommonAlarmBuzzer: boolean
  No1FOSupplypumpRunCommand: boolean
  No2FOSupplypumpRunCommand: boolean
  toYardFOSupplypumpRunRequest: boolean
  toYardFOSupplypumpFail: boolean
  CDO1Reserved8: boolean
  CDO1Reserved9: boolean
  CDO1Reserved10: boolean
  CDO1Reserved11: boolean
  CDO1Reserved12: boolean
  CDO1Reserved13: boolean
  CDO1Reserved14: boolean
  CDO1Reserved15: boolean
  CDO1Reserved16: boolean

CommIO_typ = Simulink.Bus()
  CAI: Bus: CAI_typ
  CDI: Bus: CDI_typ
  CDO: Bus: CDO_typ

CommIO_typ_s = struct(
  CAI=struct(
    FOSupplyInletPress=single(0),
    FOSupplyOutletPress=single(0),
    CAI1Reserved3=single(0),
    CAI1Reserved4=single(0),
    CAI1Reserved5=single(0),
    CAI1Reserved6=single(0),
    CAI1Reserved7=single(0),
    CAI1Reserved8=single(0)),
  CDI=struct(
    FOSupplypumpAutomode=false,
    AlarmReset=false,
    PLCpowerFail_Reserved=false,
    InternalpowerFail=false,
    ExternalpowerFail=false,
    FanpowerFail=false,
    ESDcircuitpowerFail=false,
    No1FOSupplypumpRemote=false,
    No1FOSupplypumpAbnormal=false,
    No1FOSupplypumpRunning=false,
    No2FOSupplypumpRemote=false,
    No2FOSupplypumpAbnormal=false,
    No2FOSupplypumpRunning=false,
    fromYardFOSupplypumpRunning=false,
    CDI1Reserved15=false,
    CDI1Reserved16=false),
  CDO=struct(
    MOCSCommonAlarm=false,
    MOCSCommonAlarmLamp=false,
    MOCSCommonAlarmBuzzer=false,
    No1FOSupplypumpRunCommand=false,
    No2FOSupplypumpRunCommand=false,
    toYardFOSupplypumpRunRequest=false,
    toYardFOSupplypumpFail=false,
    CDO1Reserved8=false,
    CDO1Reserved9=false,
    CDO1Reserved10=false,
    CDO1Reserved11=false,
    CDO1Reserved12=false,
    CDO1Reserved13=false,
    CDO1Reserved14=false,
    CDO1Reserved15=false,
    CDO1Reserved16=false))

IAI_typ = Simulink.Bus()
  MixerInletTemp: single
  ChamberInletTemp: single
  ChamberMiddleTemp: single
  ChamberOutletTemp: single
  ChamberDiffPress: single
  VentingSealingAirInletPress: single
  IAI1Reserved7: single
  IAI1Reserved8: single
  RBVPDT: single
  RTVPDT: single
  RTVFeedback: single
  IAI2Reserved4: single
  IAI2Reserved5: single
  IAI2Reserved6: single
  IAI2Reserved7: single
  IAI2Reserved8: single
  FODAtomizingAirInletPress: single
  FODAtomizingAirOutletPress: single
  FODFuelOilInletPress: single
  FODFuelOilMiddlePress: single
  FODFuelOilFlowrate_Feedback: single
  FODFuelOilOutletPress: single
  IAI3Reserved7: single
  IAI3Reserved8: single

IDI_typ = Simulink.Bus()
  GELowSulfurfuelsupplied: boolean
  MOCSRemoteLocal: boolean
  MOCSEmcystopFrompanel: boolean
  MOCSEmcystopFromECR: boolean
  MOCSEmcystopFromBridge: boolean
  MOCSStart: boolean
  MOCSPreparation: boolean
  MOCSStop: boolean
  RSVFeedback_Open: boolean
  RSVFeedback_Closed: boolean
  RBVFeedback_Open: boolean
  RBVFeedback_Closed: boolean
  FODFuelOilInletTemp: boolean
  SCRValveFeedback_Open: boolean
  SCRValveFeedback_Close: boolean
  IDI1Reserved16: boolean

IAO_typ = Simulink.Bus()
  FODFuelOilControlVV_Setpoint: single
  RTVSetpoint: single
  IAO1Reserved3: single
  IAO1Reserved4: single

IAO_typ_s = struct(
  FODFuelOilControlVV_Setpoint=single(0),
  RTVSetpoint=single(0),
  IAO1Reserved3=single(0),
  IAO1Reserved4=single(0))

IDO_typ = Simulink.Bus()
  MOCSReady: boolean
  AllFlowThroughMOCS: boolean
  MOCSActive: boolean
  MOCSFODsystemFlushRun: boolean
  FODAtomizingAirSolVV: boolean
  FODPurgingAirSolVV: boolean
  FODFuelOilInletSolVV: boolean
  FODFuelOilOutletSolVV: boolean
  FODFuelOilReturnSolVV: boolean
  RSVSetpoint: boolean
  RBVSetpoint: boolean
  VentingSealingSolVV: boolean
  SCRValveSetpoint: boolean
  IDO1Reserved14: boolean
  IDO1Reserved15: boolean
  IDO1Reserved16: boolean

IndivIO_typ = Simulink.Bus()
  IAI: Bus: IAI_typ
  IDI: Bus: IDI_typ
  IAO: Bus: IAO_typ
  IDO: Bus: IDO_typ

IndivIO_typ_s = struct(
  IAI=struct(
    MixerInletTemp=single(0),
    ChamberInletTemp=single(0),
    ChamberMiddleTemp=single(0),
    ChamberOutletTemp=single(0),
    ChamberDiffPress=single(0),
    VentingSealingAirInletPress=single(0),
    IAI1Reserved7=single(0),
    IAI1Reserved8=single(0),
    RBVPDT=single(0),
    RTVPDT=single(0),
    RTVFeedback=single(0),
    IAI2Reserved4=single(0),
    IAI2Reserved5=single(0),
    IAI2Reserved6=single(0),
    IAI2Reserved7=single(0),
    IAI2Reserved8=single(0),
    FODAtomizingAirInletPress=single(0),
    FODAtomizingAirOutletPress=single(0),
    FODFuelOilInletPress=single(0),
    FODFuelOilMiddlePress=single(0),
    FODFuelOilFlowrate_Feedback=single(0),
    FODFuelOilOutletPress=single(0),
    IAI3Reserved7=single(0),
    IAI3Reserved8=single(0)),
  IDI=struct(
    GELowSulfurfuelsupplied=false,
    MOCSRemoteLocal=false,
    MOCSEmcystopFrompanel=false,
    MOCSEmcystopFromECR=false,
    MOCSEmcystopFromBridge=false,
    MOCSStart=false,
    MOCSPreparation=false,
    MOCSStop=false,
    RSVFeedback_Open=false,
    RSVFeedback_Closed=false,
    RBVFeedback_Open=false,
    RBVFeedback_Closed=false,
    FODFuelOilInletTemp=false,
    SCRValveFeedback_Open=false,
    SCRValveFeedback_Close=false,
    IDI1Reserved16=false),
  IAO=struct(
    FODFuelOilControlVV_Setpoint=single(0),
    RTVSetpoint=single(0),
    IAO1Reserved3=single(0),
    IAO1Reserved4=single(0)),
  IDO=struct(
    MOCSReady=false,
    AllFlowThroughMOCS=false,
    MOCSActive=false,
    MOCSFODsystemFlushRun=false,
    FODAtomizingAirSolVV=false,
    FODPurgingAirSolVV=false,
    FODFuelOilInletSolVV=false,
    FODFuelOilOutletSolVV=false,
    FODFuelOilReturnSolVV=false,
    RSVSetpoint=false,
    RBVSetpoint=false,
    VentingSealingSolVV=false,
    SCRValveSetpoint=false,
    IDO1Reserved14=false,
    IDO1Reserved15=false,
    IDO1Reserved16=false))

IO_typ = Simulink.Bus()
  Comm: Bus: CommIO_typ
  No1: Bus: IndivIO_typ
  No2: Bus: IndivIO_typ
  No3: Bus: IndivIO_typ
  No4: Bus: IndivIO_typ
  No5: Bus: IndivIO_typ
  No6: Bus: IndivIO_typ
  No7: Bus: IndivIO_typ
  No8: Bus: IndivIO_typ

SystemType_typ = Simulink.Bus()  % (*Comm[0..9]: 10*)
  MOCSType: single  % (*[0]*)
  NumofGE: single  % (*[1]*)
  HeatingSystem: single  % (*[2]*)
  FOSuppUnit: single  % (*[4]*)
  SystemTypeReserved4: single
  SystemTypeReserved5: single
  SystemTypeReserved6: single
  SystemTypeReserved7: single
  SystemTypeReserved8: single
  SystemTypeReserved9: single

IF_PARA = struct(
  Common=struct(
    System=struct(
      SystemType=struct(
        MOCSType=single(0),
        NumofGE=single(0),
        HeatingSystem=single(0),
        FOSuppUnit=single(0),
        SystemTypeReserved4=single(0),
        SystemTypeReserved5=single(0),
        SystemTypeReserved6=single(0),
        SystemTypeReserved7=single(0),
        SystemTypeReserved8=single(0),
        SystemTypeReserved9=single(0)),
      CommSetting=struct(
        ValveStatusCriteria=single(0),
        FOPumpChangeOverTime=single(0),
        FOPumpChangeOverDelay=single(0),
        CommSettingReserved3=single(0),
        CommSettingReserved4=single(0)),
      SystemReserved=struct(
        SystemReserved15=single(0),
        SystemReserved16=single(0),
        SystemReserved17=single(0),
        SystemReserved18=single(0),
        SystemReserved19=single(0),
        SystemReserved20=single(0),
        SystemReserved21=single(0),
        SystemReserved22=single(0),
        SystemReserved23=single(0),
        SystemReserved24=single(0),
        SystemReserved25=single(0),
        SystemReserved26=single(0),
        SystemReserved27=single(0),
        SystemReserved28=single(0),
        SystemReserved29=single(0),
        SystemReserved30=single(0),
        SystemReserved31=single(0),
        SystemReserved32=single(0),
        SystemReserved33=single(0),
        SystemReserved34=single(0),
        SystemReserved35=single(0),
        SystemReserved36=single(0),
        SystemReserved37=single(0),
        SystemReserved38=single(0),
        SystemReserved39=single(0),
        SystemReserved40=single(0),
        SystemReserved41=single(0),
        SystemReserved42=single(0),
        SystemReserved43=single(0),
        SystemReserved44=single(0),
        SystemReserved45=single(0),
        SystemReserved46=single(0),
        SystemReserved47=single(0),
        SystemReserved48=single(0),
        SystemReserved49=single(0))),
    StateFlag=struct(
      MSSNormalFlag=struct(
        MOCSMinEngineLoad=single(0),
        MOCSReadyEngineLoad=single(0),
        MSSNormalFallingHysteresis=single(0),
        MSSNormalFallingDelay=single(0),
        MSSFlagReserved4=single(0)),
      LoadChangeFlag=struct(
        MovAvgPeriod=single(0),
        ComparePoint=single(0),
        LoadChangeThreshold=single(0),
        LoadChangeFlagReserved3=single(0),
        LoadChangeFlagReserved4=single(0)),
      SystemWarmedUpFlag=struct(
        WarmUpDTemp=single(0),
        WarmUpITemp=single(0),
        WarmUpChITemp=single(0),
        WarmUpChMTemp=single(0),
        WarmUpChOTemp=single(0)),
      TMBFlag=struct(
        TMBFlagFallingDelay=single(0),
        TMBFlagReserved1=single(0),
        TMBFlagReserved2=single(0),
        TMBFlagReserved3=single(0),
        TMBFlagReserved4=single(0)),
      FlagReserved=struct(
        FlagReserved20=single(0),
        FlagReserved21=single(0),
        FlagReserved22=single(0),
        FlagReserved23=single(0),
        FlagReserved24=single(0),
        FlagReserved25=single(0),
        FlagReserved26=single(0),
        FlagReserved27=single(0),
        FlagReserved28=single(0),
        FlagReserved29=single(0),
        FlagReserved30=single(0),
        FlagReserved31=single(0),
        FlagReserved32=single(0),
        FlagReserved33=single(0),
        FlagReserved34=single(0),
        FlagReserved35=single(0),
        FlagReserved36=single(0),
        FlagReserved37=single(0),
        FlagReserved38=single(0),
        FlagReserved39=single(0),
        FlagReserved40=single(0),
        FlagReserved41=single(0),
        FlagReserved42=single(0),
        FlagReserved43=single(0),
        FlagReserved44=single(0),
        FlagReserved45=single(0),
        FlagReserved46=single(0),
        FlagReserved47=single(0),
        FlagReserved48=single(0),
        FlagReserved49=single(0))),
    Main=struct(
      Init=struct(
        InitReserved0=single(0),
        InitReserved1=single(0),
        InitReserved2=single(0),
        InitReserved3=single(0),
        InitReserved4=single(0)),
      Sealing=struct(
        VSSolValveOpenDP=single(0),
        VSSolValveCloseDP=single(0),
        RTVOpenDP=single(0),
        RTVCloseDP=single(0),
        SealRTVSetpoint=single(0),
        VSSolValveOpenDuration=single(0),
        VSSolValveCloseDuration=single(0),
        SealingReserved7=single(0),
        SealingReserved8=single(0),
        SealingReserved9=single(0)),
      Engage=struct(
        EnRTVSlope=single(0),
        EngageReserved1=single(0),
        EngageReserved2=single(0),
        EngageReserved3=single(0),
        EngageReserved4=single(0)),
      Active=struct(
        HUTargetTemp=single(0),
        HUActiveTemp=single(0),
        HUInactiveOffsetTemp=single(0),
        ActiveReserved3=single(0),
        ActiveReserved4=single(0)),
      TMB=struct(
        TMBBypassMinDuration=single(0),
        TMBTimeoutThreshold=single(0),
        TMBReserved2=single(0),
        TMBReserved3=single(0),
        TMBReserved4=single(0)),
      Disengage=struct(
        DisenRTVSlope=single(0),
        DisengageReserved1=single(0),
        DisengageReserved2=single(0),
        DisengageReserved3=single(0),
        DisengageReserved4=single(0)),
      Airventing=struct(
        VentRTVSetpoint=single(0),
        VentDuration=single(0),
        AirVentingReserved2=single(0),
        AirVentingReserved3=single(0),
        AirVentingReserved4=single(0)),
      MOCSshutdown=struct(
        MOCSShutdownReserved0=single(0),
        MOCSShutdownReserved1=single(0),
        MOCSShutdownReserved2=single(0),
        MOCSShutdownReserved3=single(0),
        MOCSShutdownReserved4=single(0)),
      Valveshutdown=struct(
        ValveShutdownReserved0=single(0),
        ValveShutdownReserved1=single(0),
        ValveShutdownReserved2=single(0),
        ValveShutdownReserved3=single(0),
        ValveShutdownReserved4=single(0))),
    FODS=struct(
      FODSInitReady=struct(
        FODSInitReserved0=single(0),
        FODSInitReserved1=single(0),
        FODSInitReserved2=single(0),
        FODSInitReserved3=single(0),
        FODSInitReserved4=single(0)),
      FODSCooling=struct(
        FOCoolDuration=single(0),
        FODSCoolingReserved1=single(0),
        FODSCoolingReserved2=single(0),
        FODSCoolingReserved3=single(0),
        FODSCoolingReserved4=single(0)),
      FODSDosing=struct(
        PumpChangeOverTime=single(0),
        SolVVDelay=single(0),
        LowRefQFOTimeout=single(0),
        QFOLowLimitTimeout=single(0),
        SFFlowrateThHigh=single(0),
        SFFlowrateThLow=single(0),
        QFOHighLimitGain=single(0),
        QFOHighLimitMin=single(0),
        QFOLowLimitValue=single(0),
        FOCValHighLimitValue=single(0),
        FOCValLowLimitValue=single(0),
        FODSDosingReserved11=single(0),
        FODSDosingReserved12=single(0),
        FODSDosingReserved13=single(0),
        FODSDosingReserved14=single(0)),
      FODSFlushing=struct(
        FOReturnDelay=single(0),
        FOPurgingDuration=single(0),
        FODSFlushingReserved2=single(0),
        FODSFlushingReserved3=single(0),
        FODSFlushingReserved4=single(0))),
    CommonReservedCat2=struct(
      CommonReservedCat3=struct(
        CommReserved180=single(0),
        CommReserved181=single(0),
        CommReserved182=single(0),
        CommReserved183=single(0),
        CommReserved184=single(0),
        CommReserved185=single(0),
        CommReserved186=single(0),
        CommReserved187=single(0),
        CommReserved188=single(0),
        CommReserved189=single(0),
        CommReserved190=single(0),
        CommReserved191=single(0),
        CommReserved192=single(0),
        CommReserved193=single(0),
        CommReserved194=single(0),
        CommReserved195=single(0),
        CommReserved196=single(0),
        CommReserved197=single(0),
        CommReserved198=single(0),
        CommReserved199=single(0)))),
  No1=struct(
    FODSFeedforward=struct(
      FFpara=struct(NumTableRow=single(0), HeatLossTemp=single(0)),
      EngineLoad=struct(
        EngineLoad0=single(0),
        EngineLoad1=single(0),
        EngineLoad2=single(0),
        EngineLoad3=single(0),
        EngineLoad4=single(0),
        EngineLoad5=single(0),
        EngineLoad6=single(0),
        EngineLoad7=single(0),
        EngineLoad8=single(0),
        EngineLoad9=single(0),
        EngineLoad10=single(0),
        EngineLoad11=single(0)),
      ExhFlowrate=struct(
        ExhFlowrate0=single(0),
        ExhFlowrate1=single(0),
        ExhFlowrate2=single(0),
        ExhFlowrate3=single(0),
        ExhFlowrate4=single(0),
        ExhFlowrate5=single(0),
        ExhFlowrate6=single(0),
        ExhFlowrate7=single(0),
        ExhFlowrate8=single(0),
        ExhFlowrate9=single(0),
        ExhFlowrate10=single(0),
        ExhFlowrate11=single(0)),
      HUInletRefTemp=struct(
        HUInletRefTemp0=single(0),
        HUInletRefTemp1=single(0),
        HUInletRefTemp2=single(0),
        HUInletRefTemp3=single(0),
        HUInletRefTemp4=single(0),
        HUInletRefTemp5=single(0),
        HUInletRefTemp6=single(0),
        HUInletRefTemp7=single(0),
        HUInletRefTemp8=single(0),
        HUInletRefTemp9=single(0),
        HUInletRefTemp10=single(0),
        HUInletRefTemp11=single(0)),
      CorrectionFactor=struct(
        CorrectionFactor0=single(0),
        CorrectionFactor1=single(0),
        CorrectionFactor2=single(0),
        CorrectionFactor3=single(0),
        CorrectionFactor4=single(0),
        CorrectionFactor5=single(0),
        CorrectionFactor6=single(0),
        CorrectionFactor7=single(0),
        CorrectionFactor8=single(0),
        CorrectionFactor9=single(0),
        CorrectionFactor10=single(0),
        CorrectionFactor11=single(0))),
    FODSFeedback=struct(
      MOCSTempPgain=struct(
        MOCSTempPgain0=single(0),
        MOCSTempPgain1=single(0),
        MOCSTempPgain2=single(0),
        MOCSTempPgain3=single(0),
        MOCSTempPgain4=single(0),
        MOCSTempPgain5=single(0),
        MOCSTempPgain6=single(0),
        MOCSTempPgain7=single(0),
        MOCSTempPgain8=single(0),
        MOCSTempPgain9=single(0),
        MOCSTempPgain10=single(0),
        MOCSTempPgain11=single(0)),
      APIDgain=struct(
        MOCSTempIgain=single(0),
        MOCSTempDgain=single(0),
        MOCSTempNoiseSup=single(0),
        QFOPgain=single(0),
        QFOIgain=single(0),
        QFODgain=single(0),
        QFONoiseSup=single(0),
        FODSFeedbackReserved19=single(0),
        FODSFeedbackReserved20=single(0),
        FODSFeedbackReserved21=single(0),
        FODSFeedbackReserved22=single(0),
        FODSFeedbackReserved23=single(0),
        FODSFeedbackReserved24=single(0))),
    IndivReservedCat2=struct(
      IndivReservedCat3=struct(
        IndivReserved75=single(0),
        IndivReserved76=single(0),
        IndivReserved77=single(0),
        IndivReserved78=single(0),
        IndivReserved79=single(0),
        IndivReserved80=single(0),
        IndivReserved81=single(0),
        IndivReserved82=single(0),
        IndivReserved83=single(0),
        IndivReserved84=single(0),
        IndivReserved85=single(0),
        IndivReserved86=single(0),
        IndivReserved87=single(0),
        IndivReserved88=single(0),
        IndivReserved89=single(0),
        IndivReserved90=single(0),
        IndivReserved91=single(0),
        IndivReserved92=single(0),
        IndivReserved93=single(0),
        IndivReserved94=single(0),
        IndivReserved95=single(0),
        IndivReserved96=single(0),
        IndivReserved97=single(0),
        IndivReserved98=single(0),
        IndivReserved99=single(0)))),
  No2=struct(
    FODSFeedforward=struct(
      FFpara=struct(NumTableRow=single(0), HeatLossTemp=single(0)),
      EngineLoad=struct(
        EngineLoad0=single(0),
        EngineLoad1=single(0),
        EngineLoad2=single(0),
        EngineLoad3=single(0),
        EngineLoad4=single(0),
        EngineLoad5=single(0),
        EngineLoad6=single(0),
        EngineLoad7=single(0),
        EngineLoad8=single(0),
        EngineLoad9=single(0),
        EngineLoad10=single(0),
        EngineLoad11=single(0)),
      ExhFlowrate=struct(
        ExhFlowrate0=single(0),
        ExhFlowrate1=single(0),
        ExhFlowrate2=single(0),
        ExhFlowrate3=single(0),
        ExhFlowrate4=single(0),
        ExhFlowrate5=single(0),
        ExhFlowrate6=single(0),
        ExhFlowrate7=single(0),
        ExhFlowrate8=single(0),
        ExhFlowrate9=single(0),
        ExhFlowrate10=single(0),
        ExhFlowrate11=single(0)),
      HUInletRefTemp=struct(
        HUInletRefTemp0=single(0),
        HUInletRefTemp1=single(0),
        HUInletRefTemp2=single(0),
        HUInletRefTemp3=single(0),
        HUInletRefTemp4=single(0),
        HUInletRefTemp5=single(0),
        HUInletRefTemp6=single(0),
        HUInletRefTemp7=single(0),
        HUInletRefTemp8=single(0),
        HUInletRefTemp9=single(0),
        HUInletRefTemp10=single(0),
        HUInletRefTemp11=single(0)),
      CorrectionFactor=struct(
        CorrectionFactor0=single(0),
        CorrectionFactor1=single(0),
        CorrectionFactor2=single(0),
        CorrectionFactor3=single(0),
        CorrectionFactor4=single(0),
        CorrectionFactor5=single(0),
        CorrectionFactor6=single(0),
        CorrectionFactor7=single(0),
        CorrectionFactor8=single(0),
        CorrectionFactor9=single(0),
        CorrectionFactor10=single(0),
        CorrectionFactor11=single(0))),
    FODSFeedback=struct(
      MOCSTempPgain=struct(
        MOCSTempPgain0=single(0),
        MOCSTempPgain1=single(0),
        MOCSTempPgain2=single(0),
        MOCSTempPgain3=single(0),
        MOCSTempPgain4=single(0),
        MOCSTempPgain5=single(0),
        MOCSTempPgain6=single(0),
        MOCSTempPgain7=single(0),
        MOCSTempPgain8=single(0),
        MOCSTempPgain9=single(0),
        MOCSTempPgain10=single(0),
        MOCSTempPgain11=single(0)),
      APIDgain=struct(
        MOCSTempIgain=single(0),
        MOCSTempDgain=single(0),
        MOCSTempNoiseSup=single(0),
        QFOPgain=single(0),
        QFOIgain=single(0),
        QFODgain=single(0),
        QFONoiseSup=single(0),
        FODSFeedbackReserved19=single(0),
        FODSFeedbackReserved20=single(0),
        FODSFeedbackReserved21=single(0),
        FODSFeedbackReserved22=single(0),
        FODSFeedbackReserved23=single(0),
        FODSFeedbackReserved24=single(0))),
    IndivReservedCat2=struct(
      IndivReservedCat3=struct(
        IndivReserved75=single(0),
        IndivReserved76=single(0),
        IndivReserved77=single(0),
        IndivReserved78=single(0),
        IndivReserved79=single(0),
        IndivReserved80=single(0),
        IndivReserved81=single(0),
        IndivReserved82=single(0),
        IndivReserved83=single(0),
        IndivReserved84=single(0),
        IndivReserved85=single(0),
        IndivReserved86=single(0),
        IndivReserved87=single(0),
        IndivReserved88=single(0),
        IndivReserved89=single(0),
        IndivReserved90=single(0),
        IndivReserved91=single(0),
        IndivReserved92=single(0),
        IndivReserved93=single(0),
        IndivReserved94=single(0),
        IndivReserved95=single(0),
        IndivReserved96=single(0),
        IndivReserved97=single(0),
        IndivReserved98=single(0),
        IndivReserved99=single(0)))),
  No3=struct(
    FODSFeedforward=struct(
      FFpara=struct(NumTableRow=single(0), HeatLossTemp=single(0)),
      EngineLoad=struct(
        EngineLoad0=single(0),
        EngineLoad1=single(0),
        EngineLoad2=single(0),
        EngineLoad3=single(0),
        EngineLoad4=single(0),
        EngineLoad5=single(0),
        EngineLoad6=single(0),
        EngineLoad7=single(0),
        EngineLoad8=single(0),
        EngineLoad9=single(0),
        EngineLoad10=single(0),
        EngineLoad11=single(0)),
      ExhFlowrate=struct(
        ExhFlowrate0=single(0),
        ExhFlowrate1=single(0),
        ExhFlowrate2=single(0),
        ExhFlowrate3=single(0),
        ExhFlowrate4=single(0),
        ExhFlowrate5=single(0),
        ExhFlowrate6=single(0),
        ExhFlowrate7=single(0),
        ExhFlowrate8=single(0),
        ExhFlowrate9=single(0),
        ExhFlowrate10=single(0),
        ExhFlowrate11=single(0)),
      HUInletRefTemp=struct(
        HUInletRefTemp0=single(0),
        HUInletRefTemp1=single(0),
        HUInletRefTemp2=single(0),
        HUInletRefTemp3=single(0),
        HUInletRefTemp4=single(0),
        HUInletRefTemp5=single(0),
        HUInletRefTemp6=single(0),
        HUInletRefTemp7=single(0),
        HUInletRefTemp8=single(0),
        HUInletRefTemp9=single(0),
        HUInletRefTemp10=single(0),
        HUInletRefTemp11=single(0)),
      CorrectionFactor=struct(
        CorrectionFactor0=single(0),
        CorrectionFactor1=single(0),
        CorrectionFactor2=single(0),
        CorrectionFactor3=single(0),
        CorrectionFactor4=single(0),
        CorrectionFactor5=single(0),
        CorrectionFactor6=single(0),
        CorrectionFactor7=single(0),
        CorrectionFactor8=single(0),
        CorrectionFactor9=single(0),
        CorrectionFactor10=single(0),
        CorrectionFactor11=single(0))),
    FODSFeedback=struct(
      MOCSTempPgain=struct(
        MOCSTempPgain0=single(0),
        MOCSTempPgain1=single(0),
        MOCSTempPgain2=single(0),
        MOCSTempPgain3=single(0),
        MOCSTempPgain4=single(0),
        MOCSTempPgain5=single(0),
        MOCSTempPgain6=single(0),
        MOCSTempPgain7=single(0),
        MOCSTempPgain8=single(0),
        MOCSTempPgain9=single(0),
        MOCSTempPgain10=single(0),
        MOCSTempPgain11=single(0)),
      APIDgain=struct(
        MOCSTempIgain=single(0),
        MOCSTempDgain=single(0),
        MOCSTempNoiseSup=single(0),
        QFOPgain=single(0),
        QFOIgain=single(0),
        QFODgain=single(0),
        QFONoiseSup=single(0),
        FODSFeedbackReserved19=single(0),
        FODSFeedbackReserved20=single(0),
        FODSFeedbackReserved21=single(0),
        FODSFeedbackReserved22=single(0),
        FODSFeedbackReserved23=single(0),
        FODSFeedbackReserved24=single(0))),
    IndivReservedCat2=struct(
      IndivReservedCat3=struct(
        IndivReserved75=single(0),
        IndivReserved76=single(0),
        IndivReserved77=single(0),
        IndivReserved78=single(0),
        IndivReserved79=single(0),
        IndivReserved80=single(0),
        IndivReserved81=single(0),
        IndivReserved82=single(0),
        IndivReserved83=single(0),
        IndivReserved84=single(0),
        IndivReserved85=single(0),
        IndivReserved86=single(0),
        IndivReserved87=single(0),
        IndivReserved88=single(0),
        IndivReserved89=single(0),
        IndivReserved90=single(0),
        IndivReserved91=single(0),
        IndivReserved92=single(0),
        IndivReserved93=single(0),
        IndivReserved94=single(0),
        IndivReserved95=single(0),
        IndivReserved96=single(0),
        IndivReserved97=single(0),
        IndivReserved98=single(0),
        IndivReserved99=single(0)))),
  No4=struct(
    FODSFeedforward=struct(
      FFpara=struct(NumTableRow=single(0), HeatLossTemp=single(0)),
      EngineLoad=struct(
        EngineLoad0=single(0),
        EngineLoad1=single(0),
        EngineLoad2=single(0),
        EngineLoad3=single(0),
        EngineLoad4=single(0),
        EngineLoad5=single(0),
        EngineLoad6=single(0),
        EngineLoad7=single(0),
        EngineLoad8=single(0),
        EngineLoad9=single(0),
        EngineLoad10=single(0),
        EngineLoad11=single(0)),
      ExhFlowrate=struct(
        ExhFlowrate0=single(0),
        ExhFlowrate1=single(0),
        ExhFlowrate2=single(0),
        ExhFlowrate3=single(0),
        ExhFlowrate4=single(0),
        ExhFlowrate5=single(0),
        ExhFlowrate6=single(0),
        ExhFlowrate7=single(0),
        ExhFlowrate8=single(0),
        ExhFlowrate9=single(0),
        ExhFlowrate10=single(0),
        ExhFlowrate11=single(0)),
      HUInletRefTemp=struct(
        HUInletRefTemp0=single(0),
        HUInletRefTemp1=single(0),
        HUInletRefTemp2=single(0),
        HUInletRefTemp3=single(0),
        HUInletRefTemp4=single(0),
        HUInletRefTemp5=single(0),
        HUInletRefTemp6=single(0),
        HUInletRefTemp7=single(0),
        HUInletRefTemp8=single(0),
        HUInletRefTemp9=single(0),
        HUInletRefTemp10=single(0),
        HUInletRefTemp11=single(0)),
      CorrectionFactor=struct(
        CorrectionFactor0=single(0),
        CorrectionFactor1=single(0),
        CorrectionFactor2=single(0),
        CorrectionFactor3=single(0),
        CorrectionFactor4=single(0),
        CorrectionFactor5=single(0),
        CorrectionFactor6=single(0),
        CorrectionFactor7=single(0),
        CorrectionFactor8=single(0),
        CorrectionFactor9=single(0),
        CorrectionFactor10=single(0),
        CorrectionFactor11=single(0))),
    FODSFeedback=struct(
      MOCSTempPgain=struct(
        MOCSTempPgain0=single(0),
        MOCSTempPgain1=single(0),
        MOCSTempPgain2=single(0),
        MOCSTempPgain3=single(0),
        MOCSTempPgain4=single(0),
        MOCSTempPgain5=single(0),
        MOCSTempPgain6=single(0),
        MOCSTempPgain7=single(0),
        MOCSTempPgain8=single(0),
        MOCSTempPgain9=single(0),
        MOCSTempPgain10=single(0),
        MOCSTempPgain11=single(0)),
      APIDgain=struct(
        MOCSTempIgain=single(0),
        MOCSTempDgain=single(0),
        MOCSTempNoiseSup=single(0),
        QFOPgain=single(0),
        QFOIgain=single(0),
        QFODgain=single(0),
        QFONoiseSup=single(0),
        FODSFeedbackReserved19=single(0),
        FODSFeedbackReserved20=single(0),
        FODSFeedbackReserved21=single(0),
        FODSFeedbackReserved22=single(0),
        FODSFeedbackReserved23=single(0),
        FODSFeedbackReserved24=single(0))),
    IndivReservedCat2=struct(
      IndivReservedCat3=struct(
        IndivReserved75=single(0),
        IndivReserved76=single(0),
        IndivReserved77=single(0),
        IndivReserved78=single(0),
        IndivReserved79=single(0),
        IndivReserved80=single(0),
        IndivReserved81=single(0),
        IndivReserved82=single(0),
        IndivReserved83=single(0),
        IndivReserved84=single(0),
        IndivReserved85=single(0),
        IndivReserved86=single(0),
        IndivReserved87=single(0),
        IndivReserved88=single(0),
        IndivReserved89=single(0),
        IndivReserved90=single(0),
        IndivReserved91=single(0),
        IndivReserved92=single(0),
        IndivReserved93=single(0),
        IndivReserved94=single(0),
        IndivReserved95=single(0),
        IndivReserved96=single(0),
        IndivReserved97=single(0),
        IndivReserved98=single(0),
        IndivReserved99=single(0)))),
  No5=struct(
    FODSFeedforward=struct(
      FFpara=struct(NumTableRow=single(0), HeatLossTemp=single(0)),
      EngineLoad=struct(
        EngineLoad0=single(0),
        EngineLoad1=single(0),
        EngineLoad2=single(0),
        EngineLoad3=single(0),
        EngineLoad4=single(0),
        EngineLoad5=single(0),
        EngineLoad6=single(0),
        EngineLoad7=single(0),
        EngineLoad8=single(0),
        EngineLoad9=single(0),
        EngineLoad10=single(0),
        EngineLoad11=single(0)),
      ExhFlowrate=struct(
        ExhFlowrate0=single(0),
        ExhFlowrate1=single(0),
        ExhFlowrate2=single(0),
        ExhFlowrate3=single(0),
        ExhFlowrate4=single(0),
        ExhFlowrate5=single(0),
        ExhFlowrate6=single(0),
        ExhFlowrate7=single(0),
        ExhFlowrate8=single(0),
        ExhFlowrate9=single(0),
        ExhFlowrate10=single(0),
        ExhFlowrate11=single(0)),
      HUInletRefTemp=struct(
        HUInletRefTemp0=single(0),
        HUInletRefTemp1=single(0),
        HUInletRefTemp2=single(0),
        HUInletRefTemp3=single(0),
        HUInletRefTemp4=single(0),
        HUInletRefTemp5=single(0),
        HUInletRefTemp6=single(0),
        HUInletRefTemp7=single(0),
        HUInletRefTemp8=single(0),
        HUInletRefTemp9=single(0),
        HUInletRefTemp10=single(0),
        HUInletRefTemp11=single(0)),
      CorrectionFactor=struct(
        CorrectionFactor0=single(0),
        CorrectionFactor1=single(0),
        CorrectionFactor2=single(0),
        CorrectionFactor3=single(0),
        CorrectionFactor4=single(0),
        CorrectionFactor5=single(0),
        CorrectionFactor6=single(0),
        CorrectionFactor7=single(0),
        CorrectionFactor8=single(0),
        CorrectionFactor9=single(0),
        CorrectionFactor10=single(0),
        CorrectionFactor11=single(0))),
    FODSFeedback=struct(
      MOCSTempPgain=struct(
        MOCSTempPgain0=single(0),
        MOCSTempPgain1=single(0),
        MOCSTempPgain2=single(0),
        MOCSTempPgain3=single(0),
        MOCSTempPgain4=single(0),
        MOCSTempPgain5=single(0),
        MOCSTempPgain6=single(0),
        MOCSTempPgain7=single(0),
        MOCSTempPgain8=single(0),
        MOCSTempPgain9=single(0),
        MOCSTempPgain10=single(0),
        MOCSTempPgain11=single(0)),
      APIDgain=struct(
        MOCSTempIgain=single(0),
        MOCSTempDgain=single(0),
        MOCSTempNoiseSup=single(0),
        QFOPgain=single(0),
        QFOIgain=single(0),
        QFODgain=single(0),
        QFONoiseSup=single(0),
        FODSFeedbackReserved19=single(0),
        FODSFeedbackReserved20=single(0),
        FODSFeedbackReserved21=single(0),
        FODSFeedbackReserved22=single(0),
        FODSFeedbackReserved23=single(0),
        FODSFeedbackReserved24=single(0))),
    IndivReservedCat2=struct(
      IndivReservedCat3=struct(
        IndivReserved75=single(0),
        IndivReserved76=single(0),
        IndivReserved77=single(0),
        IndivReserved78=single(0),
        IndivReserved79=single(0),
        IndivReserved80=single(0),
        IndivReserved81=single(0),
        IndivReserved82=single(0),
        IndivReserved83=single(0),
        IndivReserved84=single(0),
        IndivReserved85=single(0),
        IndivReserved86=single(0),
        IndivReserved87=single(0),
        IndivReserved88=single(0),
        IndivReserved89=single(0),
        IndivReserved90=single(0),
        IndivReserved91=single(0),
        IndivReserved92=single(0),
        IndivReserved93=single(0),
        IndivReserved94=single(0),
        IndivReserved95=single(0),
        IndivReserved96=single(0),
        IndivReserved97=single(0),
        IndivReserved98=single(0),
        IndivReserved99=single(0)))),
  No6=struct(
    FODSFeedforward=struct(
      FFpara=struct(NumTableRow=single(0), HeatLossTemp=single(0)),
      EngineLoad=struct(
        EngineLoad0=single(0),
        EngineLoad1=single(0),
        EngineLoad2=single(0),
        EngineLoad3=single(0),
        EngineLoad4=single(0),
        EngineLoad5=single(0),
        EngineLoad6=single(0),
        EngineLoad7=single(0),
        EngineLoad8=single(0),
        EngineLoad9=single(0),
        EngineLoad10=single(0),
        EngineLoad11=single(0)),
      ExhFlowrate=struct(
        ExhFlowrate0=single(0),
        ExhFlowrate1=single(0),
        ExhFlowrate2=single(0),
        ExhFlowrate3=single(0),
        ExhFlowrate4=single(0),
        ExhFlowrate5=single(0),
        ExhFlowrate6=single(0),
        ExhFlowrate7=single(0),
        ExhFlowrate8=single(0),
        ExhFlowrate9=single(0),
        ExhFlowrate10=single(0),
        ExhFlowrate11=single(0)),
      HUInletRefTemp=struct(
        HUInletRefTemp0=single(0),
        HUInletRefTemp1=single(0),
        HUInletRefTemp2=single(0),
        HUInletRefTemp3=single(0),
        HUInletRefTemp4=single(0),
        HUInletRefTemp5=single(0),
        HUInletRefTemp6=single(0),
        HUInletRefTemp7=single(0),
        HUInletRefTemp8=single(0),
        HUInletRefTemp9=single(0),
        HUInletRefTemp10=single(0),
        HUInletRefTemp11=single(0)),
      CorrectionFactor=struct(
        CorrectionFactor0=single(0),
        CorrectionFactor1=single(0),
        CorrectionFactor2=single(0),
        CorrectionFactor3=single(0),
        CorrectionFactor4=single(0),
        CorrectionFactor5=single(0),
        CorrectionFactor6=single(0),
        CorrectionFactor7=single(0),
        CorrectionFactor8=single(0),
        CorrectionFactor9=single(0),
        CorrectionFactor10=single(0),
        CorrectionFactor11=single(0))),
    FODSFeedback=struct(
      MOCSTempPgain=struct(
        MOCSTempPgain0=single(0),
        MOCSTempPgain1=single(0),
        MOCSTempPgain2=single(0),
        MOCSTempPgain3=single(0),
        MOCSTempPgain4=single(0),
        MOCSTempPgain5=single(0),
        MOCSTempPgain6=single(0),
        MOCSTempPgain7=single(0),
        MOCSTempPgain8=single(0),
        MOCSTempPgain9=single(0),
        MOCSTempPgain10=single(0),
        MOCSTempPgain11=single(0)),
      APIDgain=struct(
        MOCSTempIgain=single(0),
        MOCSTempDgain=single(0),
        MOCSTempNoiseSup=single(0),
        QFOPgain=single(0),
        QFOIgain=single(0),
        QFODgain=single(0),
        QFONoiseSup=single(0),
        FODSFeedbackReserved19=single(0),
        FODSFeedbackReserved20=single(0),
        FODSFeedbackReserved21=single(0),
        FODSFeedbackReserved22=single(0),
        FODSFeedbackReserved23=single(0),
        FODSFeedbackReserved24=single(0))),
    IndivReservedCat2=struct(
      IndivReservedCat3=struct(
        IndivReserved75=single(0),
        IndivReserved76=single(0),
        IndivReserved77=single(0),
        IndivReserved78=single(0),
        IndivReserved79=single(0),
        IndivReserved80=single(0),
        IndivReserved81=single(0),
        IndivReserved82=single(0),
        IndivReserved83=single(0),
        IndivReserved84=single(0),
        IndivReserved85=single(0),
        IndivReserved86=single(0),
        IndivReserved87=single(0),
        IndivReserved88=single(0),
        IndivReserved89=single(0),
        IndivReserved90=single(0),
        IndivReserved91=single(0),
        IndivReserved92=single(0),
        IndivReserved93=single(0),
        IndivReserved94=single(0),
        IndivReserved95=single(0),
        IndivReserved96=single(0),
        IndivReserved97=single(0),
        IndivReserved98=single(0),
        IndivReserved99=single(0)))),
  No7=struct(
    FODSFeedforward=struct(
      FFpara=struct(NumTableRow=single(0), HeatLossTemp=single(0)),
      EngineLoad=struct(
        EngineLoad0=single(0),
        EngineLoad1=single(0),
        EngineLoad2=single(0),
        EngineLoad3=single(0),
        EngineLoad4=single(0),
        EngineLoad5=single(0),
        EngineLoad6=single(0),
        EngineLoad7=single(0),
        EngineLoad8=single(0),
        EngineLoad9=single(0),
        EngineLoad10=single(0),
        EngineLoad11=single(0)),
      ExhFlowrate=struct(
        ExhFlowrate0=single(0),
        ExhFlowrate1=single(0),
        ExhFlowrate2=single(0),
        ExhFlowrate3=single(0),
        ExhFlowrate4=single(0),
        ExhFlowrate5=single(0),
        ExhFlowrate6=single(0),
        ExhFlowrate7=single(0),
        ExhFlowrate8=single(0),
        ExhFlowrate9=single(0),
        ExhFlowrate10=single(0),
        ExhFlowrate11=single(0)),
      HUInletRefTemp=struct(
        HUInletRefTemp0=single(0),
        HUInletRefTemp1=single(0),
        HUInletRefTemp2=single(0),
        HUInletRefTemp3=single(0),
        HUInletRefTemp4=single(0),
        HUInletRefTemp5=single(0),
        HUInletRefTemp6=single(0),
        HUInletRefTemp7=single(0),
        HUInletRefTemp8=single(0),
        HUInletRefTemp9=single(0),
        HUInletRefTemp10=single(0),
        HUInletRefTemp11=single(0)),
      CorrectionFactor=struct(
        CorrectionFactor0=single(0),
        CorrectionFactor1=single(0),
        CorrectionFactor2=single(0),
        CorrectionFactor3=single(0),
        CorrectionFactor4=single(0),
        CorrectionFactor5=single(0),
        CorrectionFactor6=single(0),
        CorrectionFactor7=single(0),
        CorrectionFactor8=single(0),
        CorrectionFactor9=single(0),
        CorrectionFactor10=single(0),
        CorrectionFactor11=single(0))),
    FODSFeedback=struct(
      MOCSTempPgain=struct(
        MOCSTempPgain0=single(0),
        MOCSTempPgain1=single(0),
        MOCSTempPgain2=single(0),
        MOCSTempPgain3=single(0),
        MOCSTempPgain4=single(0),
        MOCSTempPgain5=single(0),
        MOCSTempPgain6=single(0),
        MOCSTempPgain7=single(0),
        MOCSTempPgain8=single(0),
        MOCSTempPgain9=single(0),
        MOCSTempPgain10=single(0),
        MOCSTempPgain11=single(0)),
      APIDgain=struct(
        MOCSTempIgain=single(0),
        MOCSTempDgain=single(0),
        MOCSTempNoiseSup=single(0),
        QFOPgain=single(0),
        QFOIgain=single(0),
        QFODgain=single(0),
        QFONoiseSup=single(0),
        FODSFeedbackReserved19=single(0),
        FODSFeedbackReserved20=single(0),
        FODSFeedbackReserved21=single(0),
        FODSFeedbackReserved22=single(0),
        FODSFeedbackReserved23=single(0),
        FODSFeedbackReserved24=single(0))),
    IndivReservedCat2=struct(
      IndivReservedCat3=struct(
        IndivReserved75=single(0),
        IndivReserved76=single(0),
        IndivReserved77=single(0),
        IndivReserved78=single(0),
        IndivReserved79=single(0),
        IndivReserved80=single(0),
        IndivReserved81=single(0),
        IndivReserved82=single(0),
        IndivReserved83=single(0),
        IndivReserved84=single(0),
        IndivReserved85=single(0),
        IndivReserved86=single(0),
        IndivReserved87=single(0),
        IndivReserved88=single(0),
        IndivReserved89=single(0),
        IndivReserved90=single(0),
        IndivReserved91=single(0),
        IndivReserved92=single(0),
        IndivReserved93=single(0),
        IndivReserved94=single(0),
        IndivReserved95=single(0),
        IndivReserved96=single(0),
        IndivReserved97=single(0),
        IndivReserved98=single(0),
        IndivReserved99=single(0)))),
  No8=struct(
    FODSFeedforward=struct(
      FFpara=struct(NumTableRow=single(0), HeatLossTemp=single(0)),
      EngineLoad=struct(
        EngineLoad0=single(0),
        EngineLoad1=single(0),
        EngineLoad2=single(0),
        EngineLoad3=single(0),
        EngineLoad4=single(0),
        EngineLoad5=single(0),
        EngineLoad6=single(0),
        EngineLoad7=single(0),
        EngineLoad8=single(0),
        EngineLoad9=single(0),
        EngineLoad10=single(0),
        EngineLoad11=single(0)),
      ExhFlowrate=struct(
        ExhFlowrate0=single(0),
        ExhFlowrate1=single(0),
        ExhFlowrate2=single(0),
        ExhFlowrate3=single(0),
        ExhFlowrate4=single(0),
        ExhFlowrate5=single(0),
        ExhFlowrate6=single(0),
        ExhFlowrate7=single(0),
        ExhFlowrate8=single(0),
        ExhFlowrate9=single(0),
        ExhFlowrate10=single(0),
        ExhFlowrate11=single(0)),
      HUInletRefTemp=struct(
        HUInletRefTemp0=single(0),
        HUInletRefTemp1=single(0),
        HUInletRefTemp2=single(0),
        HUInletRefTemp3=single(0),
        HUInletRefTemp4=single(0),
        HUInletRefTemp5=single(0),
        HUInletRefTemp6=single(0),
        HUInletRefTemp7=single(0),
        HUInletRefTemp8=single(0),
        HUInletRefTemp9=single(0),
        HUInletRefTemp10=single(0),
        HUInletRefTemp11=single(0)),
      CorrectionFactor=struct(
        CorrectionFactor0=single(0),
        CorrectionFactor1=single(0),
        CorrectionFactor2=single(0),
        CorrectionFactor3=single(0),
        CorrectionFactor4=single(0),
        CorrectionFactor5=single(0),
        CorrectionFactor6=single(0),
        CorrectionFactor7=single(0),
        CorrectionFactor8=single(0),
        CorrectionFactor9=single(0),
        CorrectionFactor10=single(0),
        CorrectionFactor11=single(0))),
    FODSFeedback=struct(
      MOCSTempPgain=struct(
        MOCSTempPgain0=single(0),
        MOCSTempPgain1=single(0),
        MOCSTempPgain2=single(0),
        MOCSTempPgain3=single(0),
        MOCSTempPgain4=single(0),
        MOCSTempPgain5=single(0),
        MOCSTempPgain6=single(0),
        MOCSTempPgain7=single(0),
        MOCSTempPgain8=single(0),
        MOCSTempPgain9=single(0),
        MOCSTempPgain10=single(0),
        MOCSTempPgain11=single(0)),
      APIDgain=struct(
        MOCSTempIgain=single(0),
        MOCSTempDgain=single(0),
        MOCSTempNoiseSup=single(0),
        QFOPgain=single(0),
        QFOIgain=single(0),
        QFODgain=single(0),
        QFONoiseSup=single(0),
        FODSFeedbackReserved19=single(0),
        FODSFeedbackReserved20=single(0),
        FODSFeedbackReserved21=single(0),
        FODSFeedbackReserved22=single(0),
        FODSFeedbackReserved23=single(0),
        FODSFeedbackReserved24=single(0))),
    IndivReservedCat2=struct(
      IndivReservedCat3=struct(
        IndivReserved75=single(0),
        IndivReserved76=single(0),
        IndivReserved77=single(0),
        IndivReserved78=single(0),
        IndivReserved79=single(0),
        IndivReserved80=single(0),
        IndivReserved81=single(0),
        IndivReserved82=single(0),
        IndivReserved83=single(0),
        IndivReserved84=single(0),
        IndivReserved85=single(0),
        IndivReserved86=single(0),
        IndivReserved87=single(0),
        IndivReserved88=single(0),
        IndivReserved89=single(0),
        IndivReserved90=single(0),
        IndivReserved91=single(0),
        IndivReserved92=single(0),
        IndivReserved93=single(0),
        IndivReserved94=single(0),
        IndivReserved95=single(0),
        IndivReserved96=single(0),
        IndivReserved97=single(0),
        IndivReserved98=single(0),
        IndivReserved99=single(0)))))

CommSetting_typ = Simulink.Bus()  % (*Comm[10..14]: 5*)
  ValveStatusCriteria: single
  FOPumpChangeOverTime: single
  FOPumpChangeOverDelay: single
  CommSettingReserved3: single
  CommSettingReserved4: single

CommSetting_typ_s = struct(
  ValveStatusCriteria=single(0),
  FOPumpChangeOverTime=single(0),
  FOPumpChangeOverDelay=single(0),
  CommSettingReserved3=single(0),
  CommSettingReserved4=single(0))

SystemReserved_typ = Simulink.Bus()  % (*Comm[15..49]: 35*)
  SystemReserved15: single
  SystemReserved16: single
  SystemReserved17: single
  SystemReserved18: single
  SystemReserved19: single
  SystemReserved20: single
  SystemReserved21: single
  SystemReserved22: single
  SystemReserved23: single
  SystemReserved24: single
  SystemReserved25: single
  SystemReserved26: single
  SystemReserved27: single
  SystemReserved28: single
  SystemReserved29: single
  SystemReserved30: single
  SystemReserved31: single
  SystemReserved32: single
  SystemReserved33: single
  SystemReserved34: single
  SystemReserved35: single
  SystemReserved36: single
  SystemReserved37: single
  SystemReserved38: single
  SystemReserved39: single
  SystemReserved40: single
  SystemReserved41: single
  SystemReserved42: single
  SystemReserved43: single
  SystemReserved44: single
  SystemReserved45: single
  SystemReserved46: single
  SystemReserved47: single
  SystemReserved48: single
  SystemReserved49: single

System_typ = Simulink.Bus()  % (*Comm[0..49]: 50*)
  SystemType: Bus: SystemType_typ
  CommSetting: Bus: CommSetting_typ
  SystemReserved: Bus: SystemReserved_typ

System_typ_s = struct(
  SystemType=struct(
    MOCSType=single(0),
    NumofGE=single(0),
    HeatingSystem=single(0),
    FOSuppUnit=single(0),
    SystemTypeReserved4=single(0),
    SystemTypeReserved5=single(0),
    SystemTypeReserved6=single(0),
    SystemTypeReserved7=single(0),
    SystemTypeReserved8=single(0),
    SystemTypeReserved9=single(0)),
  CommSetting=struct(
    ValveStatusCriteria=single(0),
    FOPumpChangeOverTime=single(0),
    FOPumpChangeOverDelay=single(0),
    CommSettingReserved3=single(0),
    CommSettingReserved4=single(0)),
  SystemReserved=struct(
    SystemReserved15=single(0),
    SystemReserved16=single(0),
    SystemReserved17=single(0),
    SystemReserved18=single(0),
    SystemReserved19=single(0),
    SystemReserved20=single(0),
    SystemReserved21=single(0),
    SystemReserved22=single(0),
    SystemReserved23=single(0),
    SystemReserved24=single(0),
    SystemReserved25=single(0),
    SystemReserved26=single(0),
    SystemReserved27=single(0),
    SystemReserved28=single(0),
    SystemReserved29=single(0),
    SystemReserved30=single(0),
    SystemReserved31=single(0),
    SystemReserved32=single(0),
    SystemReserved33=single(0),
    SystemReserved34=single(0),
    SystemReserved35=single(0),
    SystemReserved36=single(0),
    SystemReserved37=single(0),
    SystemReserved38=single(0),
    SystemReserved39=single(0),
    SystemReserved40=single(0),
    SystemReserved41=single(0),
    SystemReserved42=single(0),
    SystemReserved43=single(0),
    SystemReserved44=single(0),
    SystemReserved45=single(0),
    SystemReserved46=single(0),
    SystemReserved47=single(0),
    SystemReserved48=single(0),
    SystemReserved49=single(0)))

MSSNormalFlag_typ = Simulink.Bus()  % (*Comm[50..54]: 5*)
  MOCSMinEngineLoad: single
  MOCSReadyEngineLoad: single
  MSSNormalFallingHysteresis: single
  MSSNormalFallingDelay: single
  MSSFlagReserved4: single

MSSNormalFlag_typ_s = struct(
  MOCSMinEngineLoad=single(0),
  MOCSReadyEngineLoad=single(0),
  MSSNormalFallingHysteresis=single(0),
  MSSNormalFallingDelay=single(0),
  MSSFlagReserved4=single(0))

LoadChangeFlag_typ = Simulink.Bus()  % (*Comm[55..59]: 5*)
  MovAvgPeriod: single
  ComparePoint: single
  LoadChangeThreshold: single
  LoadChangeFlagReserved3: single
  LoadChangeFlagReserved4: single

LoadChangeFlag_typ_s = struct(
  MovAvgPeriod=single(0),
  ComparePoint=single(0),
  LoadChangeThreshold=single(0),
  LoadChangeFlagReserved3=single(0),
  LoadChangeFlagReserved4=single(0))

SystemWarmedUpFlag_typ = Simulink.Bus()  % (*Comm[60..64]: 5*)
  WarmUpDTemp: single
  WarmUpITemp: single
  WarmUpChITemp: single
  WarmUpChMTemp: single
  WarmUpChOTemp: single

SystemWarmedUpFlag_typ_s = struct(
  WarmUpDTemp=single(0),
  WarmUpITemp=single(0),
  WarmUpChITemp=single(0),
  WarmUpChMTemp=single(0),
  WarmUpChOTemp=single(0))

TMBFlag_typ = Simulink.Bus()  % (*Comm[65..69]: 5*)
  TMBFlagFallingDelay: single
  TMBFlagReserved1: single
  TMBFlagReserved2: single
  TMBFlagReserved3: single
  TMBFlagReserved4: single

TMBFlag_typ_s = struct(
  TMBFlagFallingDelay=single(0),
  TMBFlagReserved1=single(0),
  TMBFlagReserved2=single(0),
  TMBFlagReserved3=single(0),
  TMBFlagReserved4=single(0))

FlagReserved_typ = Simulink.Bus()  % (*Comm[70..99]: 30*)
  FlagReserved20: single
  FlagReserved21: single
  FlagReserved22: single
  FlagReserved23: single
  FlagReserved24: single
  FlagReserved25: single
  FlagReserved26: single
  FlagReserved27: single
  FlagReserved28: single
  FlagReserved29: single
  FlagReserved30: single
  FlagReserved31: single
  FlagReserved32: single
  FlagReserved33: single
  FlagReserved34: single
  FlagReserved35: single
  FlagReserved36: single
  FlagReserved37: single
  FlagReserved38: single
  FlagReserved39: single
  FlagReserved40: single
  FlagReserved41: single
  FlagReserved42: single
  FlagReserved43: single
  FlagReserved44: single
  FlagReserved45: single
  FlagReserved46: single
  FlagReserved47: single
  FlagReserved48: single
  FlagReserved49: single

StateFlag_typ = Simulink.Bus()  % (*Comm[50..99]: 50*)
  MSSNormalFlag: Bus: MSSNormalFlag_typ  % (*[50..54]: 5*)
  LoadChangeFlag: Bus: LoadChangeFlag_typ  % (*[55:59]: 5*)
  SystemWarmedUpFlag: Bus: SystemWarmedUpFlag_typ  % (*[60..64]: 5*)
  TMBFlag: Bus: TMBFlag_typ  % (*[65..99]: 35*)
  FlagReserved: Bus: FlagReserved_typ  % (*[65..99]: 35*)

StateFlag_typ_s = struct(
  MSSNormalFlag=struct(
    MOCSMinEngineLoad=single(0),
    MOCSReadyEngineLoad=single(0),
    MSSNormalFallingHysteresis=single(0),
    MSSNormalFallingDelay=single(0),
    MSSFlagReserved4=single(0)),
  LoadChangeFlag=struct(
    MovAvgPeriod=single(0),
    ComparePoint=single(0),
    LoadChangeThreshold=single(0),
    LoadChangeFlagReserved3=single(0),
    LoadChangeFlagReserved4=single(0)),
  SystemWarmedUpFlag=struct(
    WarmUpDTemp=single(0),
    WarmUpITemp=single(0),
    WarmUpChITemp=single(0),
    WarmUpChMTemp=single(0),
    WarmUpChOTemp=single(0)),
  TMBFlag=struct(
    TMBFlagFallingDelay=single(0),
    TMBFlagReserved1=single(0),
    TMBFlagReserved2=single(0),
    TMBFlagReserved3=single(0),
    TMBFlagReserved4=single(0)),
  FlagReserved=struct(
    FlagReserved20=single(0),
    FlagReserved21=single(0),
    FlagReserved22=single(0),
    FlagReserved23=single(0),
    FlagReserved24=single(0),
    FlagReserved25=single(0),
    FlagReserved26=single(0),
    FlagReserved27=single(0),
    FlagReserved28=single(0),
    FlagReserved29=single(0),
    FlagReserved30=single(0),
    FlagReserved31=single(0),
    FlagReserved32=single(0),
    FlagReserved33=single(0),
    FlagReserved34=single(0),
    FlagReserved35=single(0),
    FlagReserved36=single(0),
    FlagReserved37=single(0),
    FlagReserved38=single(0),
    FlagReserved39=single(0),
    FlagReserved40=single(0),
    FlagReserved41=single(0),
    FlagReserved42=single(0),
    FlagReserved43=single(0),
    FlagReserved44=single(0),
    FlagReserved45=single(0),
    FlagReserved46=single(0),
    FlagReserved47=single(0),
    FlagReserved48=single(0),
    FlagReserved49=single(0)))

Init_typ = Simulink.Bus()  % (*Comm[100..104]: 5*)
  InitReserved0: single
  InitReserved1: single
  InitReserved2: single
  InitReserved3: single
  InitReserved4: single

Init_typ_s = struct(
  InitReserved0=single(0),
  InitReserved1=single(0),
  InitReserved2=single(0),
  InitReserved3=single(0),
  InitReserved4=single(0))

Sealing_typ = Simulink.Bus()  % (*Comm[105..114]: 10*)
  VSSolValveOpenDP: single
  VSSolValveCloseDP: single
  RTVOpenDP: single
  RTVCloseDP: single
  SealRTVSetpoint: single
  VSSolValveOpenDuration: single
  VSSolValveCloseDuration: single
  SealingReserved7: single
  SealingReserved8: single
  SealingReserved9: single

Engage_typ = Simulink.Bus()  % (*Comm[115..119]: 5*)
  EnRTVSlope: single
  EngageReserved1: single
  EngageReserved2: single
  EngageReserved3: single
  EngageReserved4: single

Engage_typ_s = struct(
  EnRTVSlope=single(0),
  EngageReserved1=single(0),
  EngageReserved2=single(0),
  EngageReserved3=single(0),
  EngageReserved4=single(0))

Active_typ = Simulink.Bus()  % (*Comm[120..124]: 5*)
  HUTargetTemp: single
  HUActiveTemp: single
  HUInactiveOffsetTemp: single
  ActiveReserved3: single
  ActiveReserved4: single

Active_typ_s = struct(
  HUTargetTemp=single(0),
  HUActiveTemp=single(0),
  HUInactiveOffsetTemp=single(0),
  ActiveReserved3=single(0),
  ActiveReserved4=single(0))

TMB_typ = Simulink.Bus()  % (*Comm[125..129]: 5*)
  TMBBypassMinDuration: single
  TMBTimeoutThreshold: single
  TMBReserved2: single
  TMBReserved3: single
  TMBReserved4: single

TMB_typ_s = struct(
  TMBBypassMinDuration=single(0),
  TMBTimeoutThreshold=single(0),
  TMBReserved2=single(0),
  TMBReserved3=single(0),
  TMBReserved4=single(0))

Disengage_typ = Simulink.Bus()  % (*Comm[130..134]: 5*)
  DisenRTVSlope: single
  DisengageReserved1: single
  DisengageReserved2: single
  DisengageReserved3: single
  DisengageReserved4: single

Disengage_typ_s = struct(
  DisenRTVSlope=single(0),
  DisengageReserved1=single(0),
  DisengageReserved2=single(0),
  DisengageReserved3=single(0),
  DisengageReserved4=single(0))

Airventing_typ = Simulink.Bus()  % (*Comm[135..139]: 5*)
  VentRTVSetpoint: single
  VentDuration: single
  AirVentingReserved2: single
  AirVentingReserved3: single
  AirVentingReserved4: single

Airventing_typ_s = struct(
  VentRTVSetpoint=single(0),
  VentDuration=single(0),
  AirVentingReserved2=single(0),
  AirVentingReserved3=single(0),
  AirVentingReserved4=single(0))

MOCSshutdown_typ = Simulink.Bus()  % (*Comm[140..144]: 5*)
  MOCSShutdownReserved0: single
  MOCSShutdownReserved1: single
  MOCSShutdownReserved2: single
  MOCSShutdownReserved3: single
  MOCSShutdownReserved4: single

MOCSshutdown_typ_s = struct(
  MOCSShutdownReserved0=single(0),
  MOCSShutdownReserved1=single(0),
  MOCSShutdownReserved2=single(0),
  MOCSShutdownReserved3=single(0),
  MOCSShutdownReserved4=single(0))

Valveshutdown_typ = Simulink.Bus()  % (*Comm[145..149]: 5*)
  ValveShutdownReserved0: single
  ValveShutdownReserved1: single
  ValveShutdownReserved2: single
  ValveShutdownReserved3: single
  ValveShutdownReserved4: single

Valveshutdown_typ_s = struct(
  ValveShutdownReserved0=single(0),
  ValveShutdownReserved1=single(0),
  ValveShutdownReserved2=single(0),
  ValveShutdownReserved3=single(0),
  ValveShutdownReserved4=single(0))

Main_typ = Simulink.Bus()  % (*Comm[100..149]: 50*)
  Init: Bus: Init_typ
  Sealing: Bus: Sealing_typ
  Engage: Bus: Engage_typ
  Active: Bus: Active_typ
  TMB: Bus: TMB_typ
  Disengage: Bus: Disengage_typ
  Airventing: Bus: Airventing_typ
  MOCSshutdown: Bus: MOCSshutdown_typ
  Valveshutdown: Bus: Valveshutdown_typ

FODSInitReady_typ = Simulink.Bus()  % (*Comm[150..154]: 5*)
  FODSInitReserved0: single
  FODSInitReserved1: single
  FODSInitReserved2: single
  FODSInitReserved3: single
  FODSInitReserved4: single

FODSInitReady_typ_s = struct(
  FODSInitReserved0=single(0),
  FODSInitReserved1=single(0),
  FODSInitReserved2=single(0),
  FODSInitReserved3=single(0),
  FODSInitReserved4=single(0))

FODSCooling_typ = Simulink.Bus()  % (*Comm[155..159]: 5*)
  FOCoolDuration: single
  FODSCoolingReserved1: single
  FODSCoolingReserved2: single
  FODSCoolingReserved3: single
  FODSCoolingReserved4: single

FODSCooling_typ_s = struct(
  FOCoolDuration=single(0),
  FODSCoolingReserved1=single(0),
  FODSCoolingReserved2=single(0),
  FODSCoolingReserved3=single(0),
  FODSCoolingReserved4=single(0))

FODSDosing_typ = Simulink.Bus()  % (*Comm[160..174]: 15*)
  PumpChangeOverTime: single
  SolVVDelay: single
  LowRefQFOTimeout: single
  QFOLowLimitTimeout: single
  SFFlowrateThHigh: single
  SFFlowrateThLow: single
  QFOHighLimitGain: single
  QFOHighLimitMin: single
  QFOLowLimitValue: single
  FOCValHighLimitValue: single
  FOCValLowLimitValue: single
  FODSDosingReserved11: single
  FODSDosingReserved12: single
  FODSDosingReserved13: single
  FODSDosingReserved14: single

FODSFlushing_typ = Simulink.Bus()  % (*Comm[175..179]: 5*)
  FOReturnDelay: single
  FOPurgingDuration: single
  FODSFlushingReserved2: single
  FODSFlushingReserved3: single
  FODSFlushingReserved4: single

FODSFlushing_typ_s = struct(
  FOReturnDelay=single(0),
  FOPurgingDuration=single(0),
  FODSFlushingReserved2=single(0),
  FODSFlushingReserved3=single(0),
  FODSFlushingReserved4=single(0))

FODS_typ = Simulink.Bus()  % (*Comm[150..179]: 30*)
  FODSInitReady: Bus: FODSInitReady_typ
  FODSCooling: Bus: FODSCooling_typ
  FODSDosing: Bus: FODSDosing_typ
  FODSFlushing: Bus: FODSFlushing_typ

FODS_typ_s = struct(
  FODSInitReady=struct(
    FODSInitReserved0=single(0),
    FODSInitReserved1=single(0),
    FODSInitReserved2=single(0),
    FODSInitReserved3=single(0),
    FODSInitReserved4=single(0)),
  FODSCooling=struct(
    FOCoolDuration=single(0),
    FODSCoolingReserved1=single(0),
    FODSCoolingReserved2=single(0),
    FODSCoolingReserved3=single(0),
    FODSCoolingReserved4=single(0)),
  FODSDosing=struct(
    PumpChangeOverTime=single(0),
    SolVVDelay=single(0),
    LowRefQFOTimeout=single(0),
    QFOLowLimitTimeout=single(0),
    SFFlowrateThHigh=single(0),
    SFFlowrateThLow=single(0),
    QFOHighLimitGain=single(0),
    QFOHighLimitMin=single(0),
    QFOLowLimitValue=single(0),
    FOCValHighLimitValue=single(0),
    FOCValLowLimitValue=single(0),
    FODSDosingReserved11=single(0),
    FODSDosingReserved12=single(0),
    FODSDosingReserved13=single(0),
    FODSDosingReserved14=single(0)),
  FODSFlushing=struct(
    FOReturnDelay=single(0),
    FOPurgingDuration=single(0),
    FODSFlushingReserved2=single(0),
    FODSFlushingReserved3=single(0),
    FODSFlushingReserved4=single(0)))

CommonReservedCat3_typ = Simulink.Bus()
  CommReserved180: single
  CommReserved181: single
  CommReserved182: single
  CommReserved183: single
  CommReserved184: single
  CommReserved185: single
  CommReserved186: single
  CommReserved187: single
  CommReserved188: single
  CommReserved189: single
  CommReserved190: single
  CommReserved191: single
  CommReserved192: single
  CommReserved193: single
  CommReserved194: single
  CommReserved195: single
  CommReserved196: single
  CommReserved197: single
  CommReserved198: single
  CommReserved199: single

CommonReservedCat2_typ = Simulink.Bus()
  CommonReservedCat3: Bus: CommonReservedCat3_typ

CommonReservedCat2_typ_s = struct(
  CommonReservedCat3=struct(
    CommReserved180=single(0),
    CommReserved181=single(0),
    CommReserved182=single(0),
    CommReserved183=single(0),
    CommReserved184=single(0),
    CommReserved185=single(0),
    CommReserved186=single(0),
    CommReserved187=single(0),
    CommReserved188=single(0),
    CommReserved189=single(0),
    CommReserved190=single(0),
    CommReserved191=single(0),
    CommReserved192=single(0),
    CommReserved193=single(0),
    CommReserved194=single(0),
    CommReserved195=single(0),
    CommReserved196=single(0),
    CommReserved197=single(0),
    CommReserved198=single(0),
    CommReserved199=single(0)))

ParaCommon_typ = Simulink.Bus()  % (*Comm[0..199]*)
  System: Bus: System_typ  % (*Comm[0..49]*)
  StateFlag: Bus: StateFlag_typ  % (*Comm[50..99]: 50*)
  Main: Bus: Main_typ  % (*Comm[100..149]: 50*)
  FODS: Bus: FODS_typ  % (*Comm[150..179]*)
  CommonReservedCat2: Bus: CommonReservedCat2_typ  % (*Comm[180..199]*)

ParaCommon_typ_s = struct(
  System=struct(
    SystemType=struct(
      MOCSType=single(0),
      NumofGE=single(0),
      HeatingSystem=single(0),
      FOSuppUnit=single(0),
      SystemTypeReserved4=single(0),
      SystemTypeReserved5=single(0),
      SystemTypeReserved6=single(0),
      SystemTypeReserved7=single(0),
      SystemTypeReserved8=single(0),
      SystemTypeReserved9=single(0)),
    CommSetting=struct(
      ValveStatusCriteria=single(0),
      FOPumpChangeOverTime=single(0),
      FOPumpChangeOverDelay=single(0),
      CommSettingReserved3=single(0),
      CommSettingReserved4=single(0)),
    SystemReserved=struct(
      SystemReserved15=single(0),
      SystemReserved16=single(0),
      SystemReserved17=single(0),
      SystemReserved18=single(0),
      SystemReserved19=single(0),
      SystemReserved20=single(0),
      SystemReserved21=single(0),
      SystemReserved22=single(0),
      SystemReserved23=single(0),
      SystemReserved24=single(0),
      SystemReserved25=single(0),
      SystemReserved26=single(0),
      SystemReserved27=single(0),
      SystemReserved28=single(0),
      SystemReserved29=single(0),
      SystemReserved30=single(0),
      SystemReserved31=single(0),
      SystemReserved32=single(0),
      SystemReserved33=single(0),
      SystemReserved34=single(0),
      SystemReserved35=single(0),
      SystemReserved36=single(0),
      SystemReserved37=single(0),
      SystemReserved38=single(0),
      SystemReserved39=single(0),
      SystemReserved40=single(0),
      SystemReserved41=single(0),
      SystemReserved42=single(0),
      SystemReserved43=single(0),
      SystemReserved44=single(0),
      SystemReserved45=single(0),
      SystemReserved46=single(0),
      SystemReserved47=single(0),
      SystemReserved48=single(0),
      SystemReserved49=single(0))),
  StateFlag=struct(
    MSSNormalFlag=struct(
      MOCSMinEngineLoad=single(0),
      MOCSReadyEngineLoad=single(0),
      MSSNormalFallingHysteresis=single(0),
      MSSNormalFallingDelay=single(0),
      MSSFlagReserved4=single(0)),
    LoadChangeFlag=struct(
      MovAvgPeriod=single(0),
      ComparePoint=single(0),
      LoadChangeThreshold=single(0),
      LoadChangeFlagReserved3=single(0),
      LoadChangeFlagReserved4=single(0)),
    SystemWarmedUpFlag=struct(
      WarmUpDTemp=single(0),
      WarmUpITemp=single(0),
      WarmUpChITemp=single(0),
      WarmUpChMTemp=single(0),
      WarmUpChOTemp=single(0)),
    TMBFlag=struct(
      TMBFlagFallingDelay=single(0),
      TMBFlagReserved1=single(0),
      TMBFlagReserved2=single(0),
      TMBFlagReserved3=single(0),
      TMBFlagReserved4=single(0)),
    FlagReserved=struct(
      FlagReserved20=single(0),
      FlagReserved21=single(0),
      FlagReserved22=single(0),
      FlagReserved23=single(0),
      FlagReserved24=single(0),
      FlagReserved25=single(0),
      FlagReserved26=single(0),
      FlagReserved27=single(0),
      FlagReserved28=single(0),
      FlagReserved29=single(0),
      FlagReserved30=single(0),
      FlagReserved31=single(0),
      FlagReserved32=single(0),
      FlagReserved33=single(0),
      FlagReserved34=single(0),
      FlagReserved35=single(0),
      FlagReserved36=single(0),
      FlagReserved37=single(0),
      FlagReserved38=single(0),
      FlagReserved39=single(0),
      FlagReserved40=single(0),
      FlagReserved41=single(0),
      FlagReserved42=single(0),
      FlagReserved43=single(0),
      FlagReserved44=single(0),
      FlagReserved45=single(0),
      FlagReserved46=single(0),
      FlagReserved47=single(0),
      FlagReserved48=single(0),
      FlagReserved49=single(0))),
  Main=struct(
    Init=struct(
      InitReserved0=single(0),
      InitReserved1=single(0),
      InitReserved2=single(0),
      InitReserved3=single(0),
      InitReserved4=single(0)),
    Sealing=struct(
      VSSolValveOpenDP=single(0),
      VSSolValveCloseDP=single(0),
      RTVOpenDP=single(0),
      RTVCloseDP=single(0),
      SealRTVSetpoint=single(0),
      VSSolValveOpenDuration=single(0),
      VSSolValveCloseDuration=single(0),
      SealingReserved7=single(0),
      SealingReserved8=single(0),
      SealingReserved9=single(0)),
    Engage=struct(
      EnRTVSlope=single(0),
      EngageReserved1=single(0),
      EngageReserved2=single(0),
      EngageReserved3=single(0),
      EngageReserved4=single(0)),
    Active=struct(
      HUTargetTemp=single(0),
      HUActiveTemp=single(0),
      HUInactiveOffsetTemp=single(0),
      ActiveReserved3=single(0),
      ActiveReserved4=single(0)),
    TMB=struct(
      TMBBypassMinDuration=single(0),
      TMBTimeoutThreshold=single(0),
      TMBReserved2=single(0),
      TMBReserved3=single(0),
      TMBReserved4=single(0)),
    Disengage=struct(
      DisenRTVSlope=single(0),
      DisengageReserved1=single(0),
      DisengageReserved2=single(0),
      DisengageReserved3=single(0),
      DisengageReserved4=single(0)),
    Airventing=struct(
      VentRTVSetpoint=single(0),
      VentDuration=single(0),
      AirVentingReserved2=single(0),
      AirVentingReserved3=single(0),
      AirVentingReserved4=single(0)),
    MOCSshutdown=struct(
      MOCSShutdownReserved0=single(0),
      MOCSShutdownReserved1=single(0),
      MOCSShutdownReserved2=single(0),
      MOCSShutdownReserved3=single(0),
      MOCSShutdownReserved4=single(0)),
    Valveshutdown=struct(
      ValveShutdownReserved0=single(0),
      ValveShutdownReserved1=single(0),
      ValveShutdownReserved2=single(0),
      ValveShutdownReserved3=single(0),
      ValveShutdownReserved4=single(0))),
  FODS=struct(
    FODSInitReady=struct(
      FODSInitReserved0=single(0),
      FODSInitReserved1=single(0),
      FODSInitReserved2=single(0),
      FODSInitReserved3=single(0),
      FODSInitReserved4=single(0)),
    FODSCooling=struct(
      FOCoolDuration=single(0),
      FODSCoolingReserved1=single(0),
      FODSCoolingReserved2=single(0),
      FODSCoolingReserved3=single(0),
      FODSCoolingReserved4=single(0)),
    FODSDosing=struct(
      PumpChangeOverTime=single(0),
      SolVVDelay=single(0),
      LowRefQFOTimeout=single(0),
      QFOLowLimitTimeout=single(0),
      SFFlowrateThHigh=single(0),
      SFFlowrateThLow=single(0),
      QFOHighLimitGain=single(0),
      QFOHighLimitMin=single(0),
      QFOLowLimitValue=single(0),
      FOCValHighLimitValue=single(0),
      FOCValLowLimitValue=single(0),
      FODSDosingReserved11=single(0),
      FODSDosingReserved12=single(0),
      FODSDosingReserved13=single(0),
      FODSDosingReserved14=single(0)),
    FODSFlushing=struct(
      FOReturnDelay=single(0),
      FOPurgingDuration=single(0),
      FODSFlushingReserved2=single(0),
      FODSFlushingReserved3=single(0),
      FODSFlushingReserved4=single(0))),
  CommonReservedCat2=struct(
    CommonReservedCat3=struct(
      CommReserved180=single(0),
      CommReserved181=single(0),
      CommReserved182=single(0),
      CommReserved183=single(0),
      CommReserved184=single(0),
      CommReserved185=single(0),
      CommReserved186=single(0),
      CommReserved187=single(0),
      CommReserved188=single(0),
      CommReserved189=single(0),
      CommReserved190=single(0),
      CommReserved191=single(0),
      CommReserved192=single(0),
      CommReserved193=single(0),
      CommReserved194=single(0),
      CommReserved195=single(0),
      CommReserved196=single(0),
      CommReserved197=single(0),
      CommReserved198=single(0),
      CommReserved199=single(0))))

FFpara_typ = Simulink.Bus()
  NumTableRow: single
  HeatLossTemp: single

FFpara_typ_s = struct(NumTableRow=single(0), HeatLossTemp=single(0))

EngineLoad_typ = Simulink.Bus()
  EngineLoad0: single
  EngineLoad1: single
  EngineLoad2: single
  EngineLoad3: single
  EngineLoad4: single
  EngineLoad5: single
  EngineLoad6: single
  EngineLoad7: single
  EngineLoad8: single
  EngineLoad9: single
  EngineLoad10: single
  EngineLoad11: single

ExhFlowrate_typ = Simulink.Bus()
  ExhFlowrate0: single
  ExhFlowrate1: single
  ExhFlowrate2: single
  ExhFlowrate3: single
  ExhFlowrate4: single
  ExhFlowrate5: single
  ExhFlowrate6: single
  ExhFlowrate7: single
  ExhFlowrate8: single
  ExhFlowrate9: single
  ExhFlowrate10: single
  ExhFlowrate11: single

HUInletRefTemp_typ = Simulink.Bus()
  HUInletRefTemp0: single
  HUInletRefTemp1: single
  HUInletRefTemp2: single
  HUInletRefTemp3: single
  HUInletRefTemp4: single
  HUInletRefTemp5: single
  HUInletRefTemp6: single
  HUInletRefTemp7: single
  HUInletRefTemp8: single
  HUInletRefTemp9: single
  HUInletRefTemp10: single
  HUInletRefTemp11: single

CorrectionFactor_typ = Simulink.Bus()
  CorrectionFactor0: single
  CorrectionFactor1: single
  CorrectionFactor2: single
  CorrectionFactor3: single
  CorrectionFactor4: single
  CorrectionFactor5: single
  CorrectionFactor6: single
  CorrectionFactor7: single
  CorrectionFactor8: single
  CorrectionFactor9: single
  CorrectionFactor10: single
  CorrectionFactor11: single

FODSFeedforward_typ = Simulink.Bus()  % (*Indiv[0..49]: 50*)
  FFpara: Bus: FFpara_typ
  EngineLoad: Bus: EngineLoad_typ
  ExhFlowrate: Bus: ExhFlowrate_typ
  HUInletRefTemp: Bus: HUInletRefTemp_typ
  CorrectionFactor: Bus: CorrectionFactor_typ

FODSFeedforward_typ_s = struct(
  FFpara=struct(NumTableRow=single(0), HeatLossTemp=single(0)),
  EngineLoad=struct(
    EngineLoad0=single(0),
    EngineLoad1=single(0),
    EngineLoad2=single(0),
    EngineLoad3=single(0),
    EngineLoad4=single(0),
    EngineLoad5=single(0),
    EngineLoad6=single(0),
    EngineLoad7=single(0),
    EngineLoad8=single(0),
    EngineLoad9=single(0),
    EngineLoad10=single(0),
    EngineLoad11=single(0)),
  ExhFlowrate=struct(
    ExhFlowrate0=single(0),
    ExhFlowrate1=single(0),
    ExhFlowrate2=single(0),
    ExhFlowrate3=single(0),
    ExhFlowrate4=single(0),
    ExhFlowrate5=single(0),
    ExhFlowrate6=single(0),
    ExhFlowrate7=single(0),
    ExhFlowrate8=single(0),
    ExhFlowrate9=single(0),
    ExhFlowrate10=single(0),
    ExhFlowrate11=single(0)),
  HUInletRefTemp=struct(
    HUInletRefTemp0=single(0),
    HUInletRefTemp1=single(0),
    HUInletRefTemp2=single(0),
    HUInletRefTemp3=single(0),
    HUInletRefTemp4=single(0),
    HUInletRefTemp5=single(0),
    HUInletRefTemp6=single(0),
    HUInletRefTemp7=single(0),
    HUInletRefTemp8=single(0),
    HUInletRefTemp9=single(0),
    HUInletRefTemp10=single(0),
    HUInletRefTemp11=single(0)),
  CorrectionFactor=struct(
    CorrectionFactor0=single(0),
    CorrectionFactor1=single(0),
    CorrectionFactor2=single(0),
    CorrectionFactor3=single(0),
    CorrectionFactor4=single(0),
    CorrectionFactor5=single(0),
    CorrectionFactor6=single(0),
    CorrectionFactor7=single(0),
    CorrectionFactor8=single(0),
    CorrectionFactor9=single(0),
    CorrectionFactor10=single(0),
    CorrectionFactor11=single(0)))

MOCSTempPgain_typ = Simulink.Bus()
  MOCSTempPgain0: single
  MOCSTempPgain1: single
  MOCSTempPgain2: single
  MOCSTempPgain3: single
  MOCSTempPgain4: single
  MOCSTempPgain5: single
  MOCSTempPgain6: single
  MOCSTempPgain7: single
  MOCSTempPgain8: single
  MOCSTempPgain9: single
  MOCSTempPgain10: single
  MOCSTempPgain11: single

APIDgain_typ = Simulink.Bus()
  MOCSTempIgain: single
  MOCSTempDgain: single
  MOCSTempNoiseSup: single
  QFOPgain: single
  QFOIgain: single
  QFODgain: single
  QFONoiseSup: single
  FODSFeedbackReserved19: single
  FODSFeedbackReserved20: single
  FODSFeedbackReserved21: single
  FODSFeedbackReserved22: single
  FODSFeedbackReserved23: single
  FODSFeedbackReserved24: single

FODSFeedback_typ = Simulink.Bus()  % (*Indiv[50..74]: 25*)
  MOCSTempPgain: Bus: MOCSTempPgain_typ
  APIDgain: Bus: APIDgain_typ

FODSFeedback_typ_s = struct(
  MOCSTempPgain=struct(
    MOCSTempPgain0=single(0),
    MOCSTempPgain1=single(0),
    MOCSTempPgain2=single(0),
    MOCSTempPgain3=single(0),
    MOCSTempPgain4=single(0),
    MOCSTempPgain5=single(0),
    MOCSTempPgain6=single(0),
    MOCSTempPgain7=single(0),
    MOCSTempPgain8=single(0),
    MOCSTempPgain9=single(0),
    MOCSTempPgain10=single(0),
    MOCSTempPgain11=single(0)),
  APIDgain=struct(
    MOCSTempIgain=single(0),
    MOCSTempDgain=single(0),
    MOCSTempNoiseSup=single(0),
    QFOPgain=single(0),
    QFOIgain=single(0),
    QFODgain=single(0),
    QFONoiseSup=single(0),
    FODSFeedbackReserved19=single(0),
    FODSFeedbackReserved20=single(0),
    FODSFeedbackReserved21=single(0),
    FODSFeedbackReserved22=single(0),
    FODSFeedbackReserved23=single(0),
    FODSFeedbackReserved24=single(0)))

IndivReservedCat3_typ = Simulink.Bus()
  IndivReserved75: single
  IndivReserved76: single
  IndivReserved77: single
  IndivReserved78: single
  IndivReserved79: single
  IndivReserved80: single
  IndivReserved81: single
  IndivReserved82: single
  IndivReserved83: single
  IndivReserved84: single
  IndivReserved85: single
  IndivReserved86: single
  IndivReserved87: single
  IndivReserved88: single
  IndivReserved89: single
  IndivReserved90: single
  IndivReserved91: single
  IndivReserved92: single
  IndivReserved93: single
  IndivReserved94: single
  IndivReserved95: single
  IndivReserved96: single
  IndivReserved97: single
  IndivReserved98: single
  IndivReserved99: single

IndivReservedCat2_typ = Simulink.Bus()  % (*Indiv[75..99]: 25*)
  IndivReservedCat3: Bus: IndivReservedCat3_typ

IndivReservedCat2_typ_s = struct(
  IndivReservedCat3=struct(
    IndivReserved75=single(0),
    IndivReserved76=single(0),
    IndivReserved77=single(0),
    IndivReserved78=single(0),
    IndivReserved79=single(0),
    IndivReserved80=single(0),
    IndivReserved81=single(0),
    IndivReserved82=single(0),
    IndivReserved83=single(0),
    IndivReserved84=single(0),
    IndivReserved85=single(0),
    IndivReserved86=single(0),
    IndivReserved87=single(0),
    IndivReserved88=single(0),
    IndivReserved89=single(0),
    IndivReserved90=single(0),
    IndivReserved91=single(0),
    IndivReserved92=single(0),
    IndivReserved93=single(0),
    IndivReserved94=single(0),
    IndivReserved95=single(0),
    IndivReserved96=single(0),
    IndivReserved97=single(0),
    IndivReserved98=single(0),
    IndivReserved99=single(0)))

ParaIndiv_typ = Simulink.Bus()  % (*Indiv[0..99]*)
  FODSFeedforward: Bus: FODSFeedforward_typ  % (*[0..49]: 50*)
  FODSFeedback: Bus: FODSFeedback_typ  % (*[50..74]: 25*)
  IndivReservedCat2: Bus: IndivReservedCat2_typ  % (*[75..99]*)

ParaIndiv_typ_s = struct(
  FODSFeedforward=struct(
    FFpara=struct(NumTableRow=single(0), HeatLossTemp=single(0)),
    EngineLoad=struct(
      EngineLoad0=single(0),
      EngineLoad1=single(0),
      EngineLoad2=single(0),
      EngineLoad3=single(0),
      EngineLoad4=single(0),
      EngineLoad5=single(0),
      EngineLoad6=single(0),
      EngineLoad7=single(0),
      EngineLoad8=single(0),
      EngineLoad9=single(0),
      EngineLoad10=single(0),
      EngineLoad11=single(0)),
    ExhFlowrate=struct(
      ExhFlowrate0=single(0),
      ExhFlowrate1=single(0),
      ExhFlowrate2=single(0),
      ExhFlowrate3=single(0),
      ExhFlowrate4=single(0),
      ExhFlowrate5=single(0),
      ExhFlowrate6=single(0),
      ExhFlowrate7=single(0),
      ExhFlowrate8=single(0),
      ExhFlowrate9=single(0),
      ExhFlowrate10=single(0),
      ExhFlowrate11=single(0)),
    HUInletRefTemp=struct(
      HUInletRefTemp0=single(0),
      HUInletRefTemp1=single(0),
      HUInletRefTemp2=single(0),
      HUInletRefTemp3=single(0),
      HUInletRefTemp4=single(0),
      HUInletRefTemp5=single(0),
      HUInletRefTemp6=single(0),
      HUInletRefTemp7=single(0),
      HUInletRefTemp8=single(0),
      HUInletRefTemp9=single(0),
      HUInletRefTemp10=single(0),
      HUInletRefTemp11=single(0)),
    CorrectionFactor=struct(
      CorrectionFactor0=single(0),
      CorrectionFactor1=single(0),
      CorrectionFactor2=single(0),
      CorrectionFactor3=single(0),
      CorrectionFactor4=single(0),
      CorrectionFactor5=single(0),
      CorrectionFactor6=single(0),
      CorrectionFactor7=single(0),
      CorrectionFactor8=single(0),
      CorrectionFactor9=single(0),
      CorrectionFactor10=single(0),
      CorrectionFactor11=single(0))),
  FODSFeedback=struct(
    MOCSTempPgain=struct(
      MOCSTempPgain0=single(0),
      MOCSTempPgain1=single(0),
      MOCSTempPgain2=single(0),
      MOCSTempPgain3=single(0),
      MOCSTempPgain4=single(0),
      MOCSTempPgain5=single(0),
      MOCSTempPgain6=single(0),
      MOCSTempPgain7=single(0),
      MOCSTempPgain8=single(0),
      MOCSTempPgain9=single(0),
      MOCSTempPgain10=single(0),
      MOCSTempPgain11=single(0)),
    APIDgain=struct(
      MOCSTempIgain=single(0),
      MOCSTempDgain=single(0),
      MOCSTempNoiseSup=single(0),
      QFOPgain=single(0),
      QFOIgain=single(0),
      QFODgain=single(0),
      QFONoiseSup=single(0),
      FODSFeedbackReserved19=single(0),
      FODSFeedbackReserved20=single(0),
      FODSFeedbackReserved21=single(0),
      FODSFeedbackReserved22=single(0),
      FODSFeedbackReserved23=single(0),
      FODSFeedbackReserved24=single(0))),
  IndivReservedCat2=struct(
    IndivReservedCat3=struct(
      IndivReserved75=single(0),
      IndivReserved76=single(0),
      IndivReserved77=single(0),
      IndivReserved78=single(0),
      IndivReserved79=single(0),
      IndivReserved80=single(0),
      IndivReserved81=single(0),
      IndivReserved82=single(0),
      IndivReserved83=single(0),
      IndivReserved84=single(0),
      IndivReserved85=single(0),
      IndivReserved86=single(0),
      IndivReserved87=single(0),
      IndivReserved88=single(0),
      IndivReserved89=single(0),
      IndivReserved90=single(0),
      IndivReserved91=single(0),
      IndivReserved92=single(0),
      IndivReserved93=single(0),
      IndivReserved94=single(0),
      IndivReserved95=single(0),
      IndivReserved96=single(0),
      IndivReserved97=single(0),
      IndivReserved98=single(0),
      IndivReserved99=single(0))))

Para_typ = Simulink.Bus()  % (*Comm[0..199], Indiv[0..99]*8*)
  Common: Bus: ParaCommon_typ
  No1: Bus: ParaIndiv_typ
  No2: Bus: ParaIndiv_typ
  No3: Bus: ParaIndiv_typ
  No4: Bus: ParaIndiv_typ
  No5: Bus: ParaIndiv_typ
  No6: Bus: ParaIndiv_typ
  No7: Bus: ParaIndiv_typ
  No8: Bus: ParaIndiv_typ