% Simulink data dictionary subDB_VALUE.sldd

Tick_100ms = Simulink.Parameter(10, DataType="single")
SamplingTime = Simulink.Parameter(0.1, DataType="single")
VAL_HU_FODS = Simulink.Parameter(0, DataType="single")
VAL_HU_NA = Simulink.Parameter(1, DataType="single")
VAL_FUEL_GAS = Simulink.Parameter(3, DataType="single")
VAL_FUEL_GASMSS = Simulink.Parameter(5, DataType="single")
VAL_EG_STARTSPEED = Simulink.Parameter(30, DataType="single")
VAL_EG_RUNSPEED = Simulink.Parameter(850, DataType="single")
VAL_MAX_DIESELRACKPOSITION = Simulink.Parameter(2, DataType="single")
VAL_FOPUMP1 = Simulink.Parameter(1, DataType="single")
VAL_FOPUMP2 = Simulink.Parameter(2, DataType="single")
Sig = Simulink.Signal()
Sig1 = Simulink.Signal()